# Grasshopper definition MAY 5.gh (Grasshopper 1.0.8)
# plug-ins: Karamba3D, Pufferfish, CORE.Grasshopper.Colibri, LunchBox, Kangaroo2 Components

panel = Panel("C:/Users/berni/Desktop/HKU_202324S2_DESN3002_ARCH7378/ScriptsForIndividual/Bernadette/model_mape_norm")
genes = GenePool(Decimals=0, Maximum=1, Minimum=0, Value=[0.5, 0.5, 0, 1, 0, 0, 0, 0, 1, 1, 0, 0, 0, 0, 1, 0.5, 0, 0.5, 0.5, 0.5])
python = GhPythonScript(port="9009")  # -> out, proxy; inputs port: Int32
# ---------- python: Python ----------
__author__ = "user"
__version__ = "2024.01.11"

import rhinoscriptsyntax as rs

from compas_cloud import Proxy

if port:
    proxy = Proxy(port=port)
# ---------- end python ----------
data = Data(python.proxy)
lng = ListLength(List=genes)
data_2 = Data(data)
python_2 = GhPythonScript(proxy=data_2, file_path=panel)  # -> proxy, out
# ---------- python_2: Python ----------
__author__ = "user"
__version__ = "2024.01.11"

import rhinoscriptsyntax as rs

if file_path:
    load_surrogate_model = proxy.function('hkua_dex_projects.berni.load_surrogate_model')
    load_surrogate_model(file_path)
# ---------- end python_2 ----------
series = Series(Start=0, Step=1, Count=lng)
dispatch = Dispatch(List=series, DispatchPattern=genes)  # -> ListA, ListB
panel_2 = Panel("""3
8
9
14""")
int = Integer(Slider(18, range=0..100))
int_2 = Integer(Slider(10, range=0..10))
int_3 = Integer(dispatch.ListA)
python_3 = GhPythonScript(indices=panel_2, n="20")  # -> out, binary; inputs indices: list of Int32, n: Int32
# ---------- python_3: Python ----------
__author__ = "tamk"
__version__ = "2024.05.11"

import rhinoscriptsyntax as rs

binary = [1. if _i in indices else 0. for _i in range(n)]
# ---------- end python_3 ----------
dom = ConstructDomain(DomainStart=0, DomainEnd=int)
dom_2 = ConstructDomain(DomainStart=0, DomainEnd=int_2)
panel_3 = Panel(int_3)
rectangle = Rectangle(Plane=PlaneXY(0, 0, 0), XSize=dom_2, YSize=dom, Radius=0)  # -> Rectangle, Length
data_3 = Data(python_2.proxy)

# ---- group: GEOMETRIES
construct_point = ConstructPoint(XCoordinate=0, YCoordinate=0, ZCoordinate=0)
construct_point_2 = ConstructPoint(XCoordinate=0, YCoordinate=0, ZCoordinate=0)
unit_y = UnitY(Factor="24.8")
move = Move(Geometry=construct_point, Motion=unit_y)  # -> Geometry, Transform
construct_point_3 = ConstructPoint(XCoordinate=0, YCoordinate=0, ZCoordinate=0)
unit_x = UnitX(Factor="10.9")
move_2 = Move(Geometry=construct_point, Motion=unit_x)  # -> Geometry, Transform
construct_point_4 = ConstructPoint(XCoordinate=0, YCoordinate=0, ZCoordinate=0)
move_3 = Move(Geometry=move.Geometry, Motion=unit_x)  # -> Geometry, Transform
construct_point_5 = ConstructPoint(XCoordinate=0, YCoordinate=0, ZCoordinate=0)
unit_y_2 = UnitY(Factor="37.2")
construct_point_6 = ConstructPoint(XCoordinate=0, YCoordinate=0, ZCoordinate=0)
unit_y_3 = UnitY(Factor="18.6")
move_4 = Move(Geometry=construct_point_3, Motion=unit_y_2)  # -> Geometry, Transform
_4point_surface = _4PointSurface(CornerA=construct_point_2, CornerB=move.Geometry, CornerC=move_3.Geometry, CornerD=move_2.Geometry)
move_5 = Move(Geometry=construct_point_4, Motion=unit_y_3)  # -> Geometry, Transform
unit_x_2 = UnitX(Factor="21.8")
move_6 = Move(Geometry=construct_point_3, Motion=unit_x_2)  # -> Geometry, Transform
unit_x_3 = UnitX(Factor="16.35")
move_7 = Move(Geometry=construct_point_4, Motion=unit_x_3)  # -> Geometry, Transform
move_8 = Move(Geometry=move_4.Geometry, Motion=unit_x_2)  # -> Geometry, Transform
brep_edges = BrepEdges(Brep=_4point_surface)  # -> Naked, Interior, NonManifold
move_9 = Move(Geometry=move_5.Geometry, Motion=unit_x_3)  # -> Geometry, Transform
join_curves = JoinCurves(Curves=brep_edges.Naked, Preserve=False)
_4point_surface_2 = _4PointSurface(CornerA=construct_point_5, CornerB=move_4.Geometry, CornerC=move_8.Geometry, CornerD=move_6.Geometry)
unit_z = UnitZ(Factor="6.13")
_4point_surface_3 = _4PointSurface(CornerA=construct_point_6, CornerB=move_5.Geometry, CornerC=move_9.Geometry, CornerD=move_7.Geometry)
move_10 = Move(Geometry=join_curves, Motion=unit_z)  # -> Geometry, Transform
list_item = ListItem(List=brep_edges.Naked, Index=Slider(0, range=0..3), Wrap=True)
list_item_2 = ListItem(List=brep_edges.Naked, Index=Slider(2, range=0..3), Wrap=True)
list_item_3 = ListItem(List=brep_edges.Naked, Index=Slider(1, range=0..3), Wrap=True)
list_item_4 = ListItem(List=brep_edges.Naked, Index=Slider(3, range=0..3), Wrap=True)
brep_edges_2 = BrepEdges(Brep=_4point_surface_2)  # -> Naked, Interior, NonManifold
brep_edges_3 = BrepEdges(Brep=_4point_surface_3)  # -> Naked, Interior, NonManifold
splitatcorners = SplitAtCorners(Poly=move_10.Geometry, Angle=1)  # -> Corners, Parts
join_curves_2 = JoinCurves(Curves=brep_edges_2.Naked, Preserve=False)
list_item_5 = ListItem(List=splitatcorners.Corners, Index=Slider(0, range=0..3), Wrap=True)
join_curves_3 = JoinCurves(Curves=brep_edges_3.Naked, Preserve=False)
unit_z_2 = UnitZ(Factor="6.13")
list_item_6 = ListItem(List=splitatcorners.Corners, Index=Slider(2, range=0..3), Wrap=True)
list_item_7 = ListItem(List=splitatcorners.Corners, Index=Slider(1, range=0..3), Wrap=True)
list_item_8 = ListItem(List=splitatcorners.Corners, Index=Slider(3, range=0..3), Wrap=True)
unit_z_3 = UnitZ(Factor="6.13")
move_11 = Move(Geometry=join_curves_2, Motion=unit_z_2)  # -> Geometry, Transform
list_item_9 = ListItem(List=brep_edges_2.Naked, Index=Slider(0, range=0..3), Wrap=True)
list_item_10 = ListItem(List=brep_edges_2.Naked, Index=Slider(2, range=0..3), Wrap=True)
list_item_11 = ListItem(List=brep_edges_2.Naked, Index=Slider(1, range=0..3), Wrap=True)
list_item_12 = ListItem(List=brep_edges_2.Naked, Index=Slider(3, range=0..3), Wrap=True)
_4point_surface_4 = _4PointSurface(CornerA=list_item_5, CornerB=list_item_7, CornerC=move.Geometry, CornerD=construct_point_2)
move_12 = Move(Geometry=join_curves_3, Motion=unit_z_3)  # -> Geometry, Transform
_4point_surface_5 = _4PointSurface(CornerA=list_item_6, CornerB=list_item_8, CornerC=move_2.Geometry, CornerD=move_3.Geometry)
_4point_surface_6 = _4PointSurface(CornerA=list_item_5, CornerB=list_item_8, CornerC=move_2.Geometry, CornerD=construct_point)
list_item_13 = ListItem(List=brep_edges_3.Naked, Index=Slider(0, range=0..3), Wrap=True)
_4point_surface_7 = _4PointSurface(CornerA=list_item_7, CornerB=list_item_6, CornerC=move_3.Geometry, CornerD=move.Geometry)
list_item_14 = ListItem(List=brep_edges_3.Naked, Index=Slider(2, range=0..3), Wrap=True)
list_item_15 = ListItem(List=brep_edges_3.Naked, Index=Slider(1, range=0..3), Wrap=True)
list_item_16 = ListItem(List=brep_edges_3.Naked, Index=Slider(3, range=0..3), Wrap=True)
surface = Surface(join_curves)
list_item_17 = ListItem(List=splitatcorners.Parts, Index=Slider(0, range=0..3), Wrap=True)
splitatcorners_2 = SplitAtCorners(Poly=move_11.Geometry, Angle=1)  # -> Corners, Parts
list_item_18 = ListItem(List=splitatcorners.Parts, Index=Slider(1, range=0..3), Wrap=True)
list_item_19 = ListItem(List=splitatcorners.Parts, Index=Slider(2, range=0..3), Wrap=True)
list_item_20 = ListItem(List=splitatcorners.Parts, Index=Slider(3, range=0..3), Wrap=True)
splitatcorners_3 = SplitAtCorners(Poly=move_12.Geometry, Angle=1)  # -> Corners, Parts
list_item_21 = ListItem(List=splitatcorners_2.Corners, Index=Slider(0, range=0..3), Wrap=True)
list_item_22 = ListItem(List=splitatcorners_2.Corners, Index=Slider(2, range=0..3), Wrap=True)
list_item_23 = ListItem(List=splitatcorners_2.Corners, Index=Slider(1, range=0..3), Wrap=True)
list_item_24 = ListItem(List=splitatcorners_2.Corners, Index=Slider(3, range=0..3), Wrap=True)
divide_curve = DivideCurve(Curve=[list_item_3, list_item_4, list_item_18, list_item_20], Count="4", Kinks=False)  # -> simplify(Points), Tangents, Parameters
list_item_25 = ListItem(List=splitatcorners_3.Corners, Index=Slider(0, range=0..3), Wrap=True)
divide_curve_2 = DivideCurve(Curve=[list_item, list_item_2, list_item_17, list_item_19], Count="8", Kinks=False)  # -> simplify(Points), Tangents, Parameters
list_item_26 = ListItem(List=splitatcorners_3.Corners, Index=Slider(2, range=0..3), Wrap=True)
list_item_27 = ListItem(List=splitatcorners_3.Corners, Index=Slider(1, range=0..3), Wrap=True)
list_item_28 = ListItem(List=splitatcorners_3.Corners, Index=Slider(3, range=0..3), Wrap=True)
_4point_surface_8 = _4PointSurface(CornerA=list_item_21, CornerB=list_item_23, CornerC=move_4.Geometry, CornerD=construct_point_5)
_4point_surface_9 = _4PointSurface(CornerA=list_item_22, CornerB=list_item_24, CornerC=move_6.Geometry, CornerD=move_8.Geometry)
_4point_surface_10 = _4PointSurface(CornerA=list_item_21, CornerB=list_item_24, CornerC=move_6.Geometry, CornerD=construct_point_3)
_4point_surface_11 = _4PointSurface(CornerA=list_item_23, CornerB=list_item_22, CornerC=move_8.Geometry, CornerD=move_4.Geometry)
_4point_surface_12 = _4PointSurface(CornerA=list_item_25, CornerB=list_item_27, CornerC=move_5.Geometry, CornerD=construct_point_6)
panel_4 = Panel(divide_curve_2.Points)
_4point_surface_13 = _4PointSurface(CornerA=list_item_26, CornerB=list_item_28, CornerC=move_7.Geometry, CornerD=move_9.Geometry)
_4point_surface_14 = _4PointSurface(CornerA=list_item_25, CornerB=list_item_28, CornerC=move_7.Geometry, CornerD=construct_point_4)
_4point_surface_15 = _4PointSurface(CornerA=list_item_27, CornerB=list_item_26, CornerC=move_9.Geometry, CornerD=move_5.Geometry)
surface_2 = Surface(join_curves_2)
list_item_29 = ListItem(List=splitatcorners_2.Parts, Index=Slider(0, range=0..3), Wrap=True)
list_item_30 = ListItem(List=splitatcorners_2.Parts, Index=Slider(1, range=0..3), Wrap=True)
list_item_31 = ListItem(List=splitatcorners_2.Parts, Index=Slider(2, range=0..3), Wrap=True)
list_item_32 = ListItem(List=splitatcorners_2.Parts, Index=Slider(3, range=0..3), Wrap=True)
tree_branch = TreeBranch(Tree=divide_curve_2.Points, Path="0", MaintainPaths=True)
surface_3 = Surface(join_curves_3)
tree_branch_2 = TreeBranch(Tree=divide_curve_2.Points, Path="0;0;0", MaintainPaths=True)
tree_branch_3 = TreeBranch(Tree=divide_curve_2.Points, Path="0;0;1", MaintainPaths=True)
list_item_33 = ListItem(List=splitatcorners_3.Parts, Index=Slider(0, range=0..3), Wrap=True)
list_item_34 = ListItem(List=splitatcorners_3.Parts, Index=Slider(1, range=0..3), Wrap=True)
list_item_35 = ListItem(List=splitatcorners_3.Parts, Index=Slider(2, range=0..3), Wrap=True)
list_item_36 = ListItem(List=splitatcorners_3.Parts, Index=Slider(3, range=0..3), Wrap=True)
tree_branch_4 = TreeBranch(Tree=divide_curve_2.Points, Path="1", MaintainPaths=True)
divide_curve_3 = DivideCurve(Curve=[list_item_11, list_item_12, list_item_30, list_item_32], Count="8", Kinks=False)  # -> simplify(Points), Tangents, Parameters
panel_5 = Panel(tree_branch)
tree_branch_5 = TreeBranch(Tree=divide_curve.Points, Path="0", MaintainPaths=True)
divide_curve_4 = DivideCurve(Curve=[list_item_9, list_item_10, list_item_29, list_item_31], Count="12", Kinks=False)  # -> simplify(Points), Tangents, Parameters
tree_branch_6 = TreeBranch(Tree=divide_curve.Points, Path="0;0;0", MaintainPaths=True)
panel_6 = Panel(tree_branch_2)
panel_7 = Panel(tree_branch_3)
tree_branch_7 = TreeBranch(Tree=divide_curve.Points, Path="0;0;1", MaintainPaths=True)
line = Line(StartPoint=tree_branch, EndPoint=tree_branch_2)
surface_split = SurfaceSplit(Surface=_4point_surface_4, Curves=line)  # -> flatten(Fragments)
tree_branch_8 = TreeBranch(Tree=divide_curve.Points, Path="1", MaintainPaths=True)
panel_8 = Panel(tree_branch_4)
line_2 = Line(StartPoint=tree_branch_3, EndPoint=tree_branch_4)
surface_split_2 = SurfaceSplit(Surface=_4point_surface_5, Curves=line_2)  # -> flatten(Fragments)
divide_curve_5 = DivideCurve(Curve=[list_item_15, list_item_16, list_item_34, list_item_36], Count="6", Kinks=False)  # -> simplify(Points), Tangents, Parameters
divide_curve_6 = DivideCurve(Curve=[list_item_13, list_item_14, list_item_33, list_item_35], Count="6", Kinks=False)  # -> simplify(Points), Tangents, Parameters
panel_9 = Panel(tree_branch_5)
panel_10 = Panel(tree_branch_6)
panel_11 = Panel(tree_branch_7)
line_3 = Line(StartPoint=tree_branch_5, EndPoint=tree_branch_6)
surface_split_3 = SurfaceSplit(Surface=_4point_surface_7, Curves=line_3)  # -> flatten(Fragments)
panel_12 = Panel(divide_curve_4.Points)
panel_13 = Panel(tree_branch_8)
line_4 = Line(StartPoint=tree_branch_7, EndPoint=tree_branch_8)
surface_split_4 = SurfaceSplit(Surface=_4point_surface_6, Curves=line_4)  # -> flatten(Fragments)
panel_14 = Panel(divide_curve_6.Points)
tree_branch_9 = TreeBranch(Tree=divide_curve_4.Points, Path="0", MaintainPaths=True)
tree_branch_10 = TreeBranch(Tree=divide_curve_4.Points, Path="0;0;0", MaintainPaths=True)
tree_branch_11 = TreeBranch(Tree=divide_curve_4.Points, Path="0;0;1", MaintainPaths=True)
tree_branch_12 = TreeBranch(Tree=divide_curve_4.Points, Path="1", MaintainPaths=True)
tree_branch_13 = TreeBranch(Tree=divide_curve_6.Points, Path="0", MaintainPaths=True)
tree_branch_14 = TreeBranch(Tree=divide_curve_6.Points, Path="0;0;0", MaintainPaths=True)
tree_branch_15 = TreeBranch(Tree=divide_curve_6.Points, Path="0;0;1", MaintainPaths=True)
tree_branch_16 = TreeBranch(Tree=divide_curve_6.Points, Path="1", MaintainPaths=True)
tree_branch_17 = TreeBranch(Tree=divide_curve_3.Points, Path="0", MaintainPaths=True)
panel_15 = Panel(tree_branch_9)
tree_branch_18 = TreeBranch(Tree=divide_curve_3.Points, Path="0;0;0", MaintainPaths=True)
panel_16 = Panel(tree_branch_10)
tree_branch_19 = TreeBranch(Tree=divide_curve_3.Points, Path="0;0;1", MaintainPaths=True)
panel_17 = Panel(tree_branch_11)
line_5 = Line(StartPoint=tree_branch_9, EndPoint=tree_branch_10)
surface_split_5 = SurfaceSplit(Surface=_4point_surface_8, Curves=line_5)  # -> flatten(Fragments)
tree_branch_20 = TreeBranch(Tree=divide_curve_3.Points, Path="1", MaintainPaths=True)
panel_18 = Panel(tree_branch_12)
line_6 = Line(StartPoint=tree_branch_11, EndPoint=tree_branch_12)
surface_split_6 = SurfaceSplit(Surface=_4point_surface_9, Curves=line_6)  # -> flatten(Fragments)
tree_branch_21 = TreeBranch(Tree=divide_curve_5.Points, Path="0", MaintainPaths=True)
panel_19 = Panel(tree_branch_13)
tree_branch_22 = TreeBranch(Tree=divide_curve_5.Points, Path="0;0;0", MaintainPaths=True)
panel_20 = Panel(tree_branch_14)
tree_branch_23 = TreeBranch(Tree=divide_curve_5.Points, Path="0;0;1", MaintainPaths=True)
panel_21 = Panel(tree_branch_15)
line_7 = Line(StartPoint=tree_branch_13, EndPoint=tree_branch_14)
surface_split_7 = SurfaceSplit(Surface=_4point_surface_12, Curves=line_7)  # -> flatten(Fragments)
tree_branch_24 = TreeBranch(Tree=divide_curve_5.Points, Path="1", MaintainPaths=True)
panel_22 = Panel(tree_branch_16)
line_8 = Line(StartPoint=tree_branch_15, EndPoint=tree_branch_16)
surface_split_8 = SurfaceSplit(Surface=_4point_surface_13, Curves=line_8)  # -> flatten(Fragments)
list_item_37 = ListItem(List=tree_branch_6, Index=Slider(2, range=0..5), Wrap=True)
panel_23 = Panel(tree_branch_17)
list_item_38 = ListItem(List=tree_branch_7, Index=Slider(2, range=0..5), Wrap=True)
panel_24 = Panel(tree_branch_18)
panel_25 = Panel(tree_branch_19)
line_9 = Line(StartPoint=tree_branch_17, EndPoint=tree_branch_18)
surface_split_9 = SurfaceSplit(Surface=_4point_surface_11, Curves=line_9)  # -> flatten(Fragments)
line_10 = Line(StartPoint=tree_branch_19, EndPoint=tree_branch_20)
surface_split_10 = SurfaceSplit(Surface=_4point_surface_10, Curves=line_10)  # -> flatten(Fragments)
panel_26 = Panel(tree_branch_20)
panel_27 = Panel(tree_branch_21)
panel_28 = Panel(tree_branch_22)
panel_29 = Panel(tree_branch_23)
line_11 = Line(StartPoint=tree_branch_21, EndPoint=tree_branch_22)
surface_split_11 = SurfaceSplit(Surface=_4point_surface_15, Curves=line_11)  # -> flatten(Fragments)
line_12 = Line(StartPoint=tree_branch_23, EndPoint=tree_branch_24)
surface_split_12 = SurfaceSplit(Surface=_4point_surface_14, Curves=line_12)  # -> flatten(Fragments)
panel_30 = Panel(tree_branch_24)
unit_z_4 = UnitZ(Factor="3.07")
unit_z_5 = UnitZ(Factor="3.07")
move_13 = Move(Geometry=list_item_37, Motion=unit_z_4)  # -> Geometry, Transform
_4point_surface_16 = _4PointSurface(CornerA=list_item_6, CornerB=list_item_37, CornerC=move_13.Geometry)
_4point_surface_17 = _4PointSurface(CornerA=list_item_6, CornerB=list_item_7, CornerC=move_13.Geometry)
move_14 = Move(Geometry=list_item_38, Motion=unit_z_5)  # -> Geometry, Transform
_4point_surface_18 = _4PointSurface(CornerA=list_item_5, CornerB=move_14.Geometry, CornerC=move_13.Geometry, CornerD=list_item_7)
_4point_surface_19 = _4PointSurface(CornerA=list_item_8, CornerB=move_14.Geometry, CornerC=move_13.Geometry, CornerD=list_item_6)
_4point_surface_20 = _4PointSurface(CornerA=move_14.Geometry, CornerB=list_item_5, CornerC=list_item_38)
_4point_surface_21 = _4PointSurface(CornerA=move_14.Geometry, CornerB=list_item_8, CornerC=list_item_38)
roombrep = Merge(
    Data1=_4point_surface_4,
    Data2=_4point_surface_5,
    Data3=_4point_surface_6,
    Data4=_4point_surface_7,
    Data5=_4point_surface_18,
    Data6=_4point_surface_19,
    Data7=_4point_surface_16,
    Data8=_4point_surface_17,
    Data9=_4point_surface_20,
    Data10=surface)
brep = Brep(roombrep)
list_item_39 = ListItem(List=tree_branch_18, Index=Slider(4, range=0..5), Wrap=True)
list_item_40 = ListItem(List=tree_branch_19, Index=Slider(4, range=0..5), Wrap=True)
list_item_41 = ListItem(List=tree_branch_22, Index=Slider(3, range=0..5), Wrap=True)
list_item_42 = ListItem(List=tree_branch_23, Index=Slider(3, range=0..5), Wrap=True)
line_13 = Line(StartPoint=move_13.Geometry, EndPoint=move_14.Geometry)
line_14 = Line(StartPoint=list_item_38, EndPoint=move_14.Geometry)
line_15 = Line(StartPoint=list_item_37, EndPoint=move_13.Geometry)
unit_z_6 = UnitZ(Factor="6.14")
unit_z_7 = UnitZ(Factor="6.14")
unit_z_8 = UnitZ(Factor="3.07")
unit_z_9 = UnitZ(Factor="3.07")
move_15 = Move(Geometry=list_item_39, Motion=unit_z_6)  # -> Geometry, Transform
_4point_surface_22 = _4PointSurface(CornerA=list_item_22, CornerB=list_item_39, CornerC=move_15.Geometry)
_4point_surface_23 = _4PointSurface(CornerA=list_item_22, CornerB=list_item_23, CornerC=move_15.Geometry)
move_16 = Move(Geometry=list_item_40, Motion=unit_z_7)  # -> Geometry, Transform
_4point_surface_24 = _4PointSurface(CornerA=list_item_21, CornerB=move_16.Geometry, CornerC=move_15.Geometry, CornerD=list_item_23)
_4point_surface_25 = _4PointSurface(CornerA=list_item_24, CornerB=move_16.Geometry, CornerC=move_15.Geometry, CornerD=list_item_22)
_4point_surface_26 = _4PointSurface(CornerA=move_16.Geometry, CornerB=list_item_21, CornerC=list_item_40)
_4point_surface_27 = _4PointSurface(CornerA=move_16.Geometry, CornerB=list_item_24, CornerC=list_item_40)
roombrep_2 = Merge(
    Data1=_4point_surface_8,
    Data2=_4point_surface_9,
    Data3=_4point_surface_10,
    Data4=_4point_surface_11,
    Data5=_4point_surface_24,
    Data6=_4point_surface_25,
    Data7=_4point_surface_22,
    Data8=_4point_surface_23,
    Data9=_4point_surface_26,
    Data10=surface_2)
brep_2 = Brep(roombrep_2)
divide_curve_7 = DivideCurve(Curve=line_13, Count="8", Kinks=False)  # -> Points, Tangents, Parameters
move_17 = Move(Geometry=list_item_41, Motion=unit_z_8)  # -> Geometry, Transform
_4point_surface_28 = _4PointSurface(CornerA=list_item_26, CornerB=list_item_41, CornerC=move_17.Geometry)
_4point_surface_29 = _4PointSurface(CornerA=list_item_26, CornerB=list_item_27, CornerC=move_17.Geometry)
move_18 = Move(Geometry=list_item_42, Motion=unit_z_9)  # -> Geometry, Transform
_4point_surface_30 = _4PointSurface(CornerA=list_item_25, CornerB=move_18.Geometry, CornerC=move_17.Geometry, CornerD=list_item_27)
_4point_surface_31 = _4PointSurface(CornerA=list_item_28, CornerB=move_18.Geometry, CornerC=move_17.Geometry, CornerD=list_item_26)
_4point_surface_32 = _4PointSurface(CornerA=move_18.Geometry, CornerB=list_item_25, CornerC=list_item_42)
_4point_surface_33 = _4PointSurface(CornerA=move_18.Geometry, CornerB=list_item_28, CornerC=list_item_42)
roombrep_3 = Merge(
    Data1=_4point_surface_12,
    Data2=_4point_surface_13,
    Data3=_4point_surface_14,
    Data4=_4point_surface_15,
    Data5=_4point_surface_30,
    Data6=_4point_surface_31,
    Data7=_4point_surface_28,
    Data8=_4point_surface_29,
    Data9=_4point_surface_32,
    Data10=surface_3)
brep_3 = Brep(roombrep_3)
line_16 = Line(StartPoint=move_15.Geometry, EndPoint=move_16.Geometry)
line_17 = Line(StartPoint=reverse(tree_branch_2), EndPoint=divide_curve_7.Points)
line_18 = Line(StartPoint=divide_curve_7.Points, EndPoint=tree_branch_3)
line_19 = Line(StartPoint=list_item_40, EndPoint=move_16.Geometry)
line_20 = Line(StartPoint=list_item_39, EndPoint=move_15.Geometry)
line_21 = Line(StartPoint=move_17.Geometry, EndPoint=move_18.Geometry)
line_22 = Line(StartPoint=list_item_42, EndPoint=move_18.Geometry)
line_23 = Line(StartPoint=list_item_41, EndPoint=move_17.Geometry)
line_24 = Line(StartPoint=move_15.Geometry, EndPoint=list_item_23)
line_25 = Line(StartPoint=move_15.Geometry, EndPoint=list_item_22)
line_26 = Line(StartPoint=move_16.Geometry, EndPoint=list_item_24)
line_27 = Line(StartPoint=move_16.Geometry, EndPoint=list_item_21)
divide_curve_8 = DivideCurve(Curve=line_16, Count="12", Kinks=False)  # -> Points, Tangents, Parameters
divide_curve_9 = DivideCurve(Curve=line_21, Count="6", Kinks=False)  # -> Points, Tangents, Parameters
divide_curve_10 = DivideCurve(Curve=line_25, Count="2", Kinks=False)  # -> Points, Tangents, Parameters
divide_curve_11 = DivideCurve(Curve=line_26, Count="2", Kinks=False)  # -> Points, Tangents, Parameters
divide_curve_12 = DivideCurve(Curve=line_27, Count="2", Kinks=False)  # -> Points, Tangents, Parameters
divide_curve_13 = DivideCurve(Curve=line_24, Count="2", Kinks=False)  # -> Points, Tangents, Parameters
line_28 = Line(StartPoint=reverse(tree_branch_10), EndPoint=divide_curve_8.Points)
line_29 = Line(StartPoint=divide_curve_8.Points, EndPoint=tree_branch_11)
line_30 = Line(StartPoint=reverse(tree_branch_14), EndPoint=divide_curve_9.Points)
line_31 = Line(StartPoint=divide_curve_9.Points, EndPoint=tree_branch_15)
list_item_43 = ListItem(List=divide_curve_10.Points, Index=Slider(1, range=0..2), Wrap=True)
list_item_44 = ListItem(List=divide_curve_13.Points, Index=Slider(1, range=0..2), Wrap=True)
list_item_45 = ListItem(List=divide_curve_12.Points, Index=Slider(1, range=0..2), Wrap=True)
list_item_46 = ListItem(List=divide_curve_11.Points, Index=Slider(1, range=0..2), Wrap=True)
line_32 = Line(StartPoint=list_item_43, EndPoint=list_item_44)
line_33 = Line(StartPoint=list_item_39, EndPoint=[list_item_44, list_item_43])
line_34 = Line(StartPoint=list_item_45, EndPoint=list_item_46)
line_35 = Line(StartPoint=list_item_40, EndPoint=[list_item_46, list_item_45])

# ----
srf = Surface(rectangle.Rectangle)
python_4 = GhPythonScript(proxy=data_3, config=genes)  # -> out, proxy, sensors; inputs config: list
# ---------- python_4: Python ----------
__author__ = "user"
__version__ = "2024.01.11"

import rhinoscriptsyntax as rs
import Grasshopper as gh
def listToTree(nestedList):
    
    """ Convert a nested python iterable to a datatree """
    
    dt = gh.DataTree[object]()
    for i,l in enumerate(nestedList):
        dt.AddRange(l,gh.Kernel.Data.GH_Path(i))
        
    return dt

if config:
    surrogate_model_predict = proxy.function('hkua_dex_projects.berni.surrogate_model_predict')
    sensors = surrogate_model_predict(config)
    
    #sensors = listToTree(sensors)
# ---------- end python_4 ----------
mesh_uv = MeshSurface(Surface=srf, UCount=int_2, VCount=int, Overhang=True, Equalize=False)
num = Number(python_4.sensors)
avr = Average(Input=num)
average_da = Panel(avr)
mesh = Mesh(mesh_uv)
panel_31 = Panel(num)
faceb = FaceBoundaries(Mesh=mesh)
lng_2 = ListLength(List=num)  # -> flatten(Length)
crv = Curve(faceb)
item = ListItem(List=lng_2, Index=0, Wrap=True)
area = Area(Geometry=crv)  # -> Area, Centroid
gradient = Gradient(
    LowerLimit=Slider(0.5, range=0..1),
    UpperLimit=Slider(0, range=0..1),
    Parameter=num,
    stops=[0: RGB(234, 38, 0), 0.25: RGB(234, 126, 0), 0.5: RGB(254, 244, 84), 0.75: RGB(173, 203, 249), 1: RGB(75, 107, 169)])
partition = PartitionList(List=crv, Size=item)  # -> simplify(Chunks)
pt = Point(area.Centroid)
mesh_2 = Mesh(partition)
preview = CustomPreview(Geometry=mesh_2, Material=gradient)
points = PointList(Points=pt)
read_file = ReadFile(File="\\Mac\Home\Desktop\FINALDATA!.csv", PerLineParse=True)
text_split = TextSplit(Text=read_file, Separators=",")  # -> simplify(Result)
panel_32 = Panel(text_split)
sub_list = SubList(List=text_split, Domain="0 to 19", Wrap=True)  # -> simplify(List), Index
list_item_47 = ListItem(List=text_split, Index="201", Wrap=True)  # -> flatten(Item)
panel_33 = Panel(sub_list.List)
panel_34 = Panel(list_item_47)
cull_index = CullIndex(List=panel_34, Indices="0", Wrap=True)
param_viewer = ParamViewer(sub_list.List)
panel_35 = Panel(cull_index)
list_indices = ListIndices(List=panel_35)
panel_36 = Panel(list_indices)
cluster = Cluster()  # -> naked_edges_3, naked_edges_2, naked_edges_4, naked_edges_5, naked_edges, naked_edges_6, naked_edges_8, naked_edges_7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
sort_list = SortList(Keys=panel_35, ValuesValuesA=panel_36)  # -> Keys, reverse(ValuesValuesA)
cull_index_2 = CullIndex(List=param_viewer, Indices="0", Wrap=True)
panel_37 = Panel(sort_list.ValuesValuesA)
tree_branch_25 = TreeBranch(Tree=sub_list.List, Path=cull_index_2, MaintainPaths=False)
panel_38 = Panel(tree_branch_25)
sub_list_2 = SubList(List=panel_37, Domain="0 to 499", Wrap=True)  # -> simplify(flatten(List)), Index
window_placement = Panel(sub_list_2.List)
original_windows = Panel("""1
4
11
14""")
tree_branch_26 = TreeBranch(Tree=panel_38, Path=window_placement, MaintainPaths=True)
all_edges = Merge(
    Data1=cluster.naked_edges_3,
    Data2=cluster.naked_edges_2,
    Data3=cluster.naked_edges_4,
    Data4=cluster.naked_edges_5,
    Data5=cluster.naked_edges,
    Data6=cluster.naked_edges_6,
    Data7=cluster.naked_edges_8,
    Data8=cluster.naked_edges_7,
    Data9=cluster.naked_edges_9,
    Data10=cluster.naked_edges_10,
    Data11=cluster.naked_edges_12,
    Data12=cluster.naked_edges_11,
    Data13=cluster.naked_edges_20,
    Data14=cluster.naked_edges_13,
    Data15=cluster.naked_edges_14,
    Data16=cluster.naked_edges_15,
    Data17=cluster.naked_edges_17,
    Data18=cluster.naked_edges_21,
    Data19=cluster.naked_edges_24,
    Data20=cluster.naked_edges_23,
    Data21=cluster.naked_edges_16,
    Data22=cluster.naked_edges_18,
    Data23=cluster.naked_edges_22,
    Data24=cluster.naked_edges_19)
ordered_panels = Merge(
    Data1=cluster.surfaces_12,
    Data2=cluster.surfaces_19,
    Data3=cluster.surfaces_14,
    Data4=cluster.surfaces_15,
    Data5=cluster.surfaces_10,
    Data6=cluster.surfaces_5,
    Data7=cluster.surfaces_2,
    Data8=cluster.surfaces_7,
    Data9=cluster.surfaces_3,
    Data10=cluster.surfaces_4,
    Data11=cluster.surfaces,
    Data12=cluster.surfaces_11,
    Data13=cluster.surfaces_9,
    Data14=cluster.surfaces_6,
    Data15=cluster.surfaces_8,
    Data16=cluster.surfaces_18,
    Data17=cluster.surfaces_20,
    Data18=cluster.surfaces_13,
    Data19=cluster.surfaces_16,
    Data20=cluster.surfaces_17)
number_slider = Slider(0, range=0..250)
window_placements = Panel(tree_branch_26)
surface_4 = Surface(ordered_panels)
python_5 = GhPythonScript()  # -> out, options
# ---------- python_5: Python ----------
__author__ = "tamk"
__version__ = "2024.03.25"

from random import randint
import rhinoscriptsyntax as rs

n_panels = 3000
n_windows = 1
n_options = 250

options = set()

while(True):
    _option = set()
    
    while(True):
        _ind = randint(0, n_panels)
        if _ind not in _option:
            _option.add(_ind)
        if len(_option) == n_windows:
            break
            
    _option = tuple(_option)
    
    if _option not in options:
        options.add(_option)
        
    if len(options) == n_options:
        break

print(options)
# ---------- end python_5 ----------
list_indices_2 = ListIndices(List=panel_35)

# ---- group: VISUALIZATION
# Animate this to go through data points!
# RightClick > Animate
# --Set View
# --Set Interval (0 to N-1)
# --Set Frame Count (N+1)
# --Set File Storage Location
# N: how many data points you have...
number_slider_2 = Slider(120, range=0..120)

# ----
verify = Panel("""8,9,7,13
17,16,18,2
4,15,5,14
14,15,16,4
0,9,8,7
4,17,11,10
0,1,7,6
2,3,1,6
4,3,5,17
10,11,16,17
0,8,9,15
5,4,3,15
4,13,12,5
0,1,11,10
2,13,17,3
6,2,7,17
6,7,5,12
9,8,7,13
13,12,2,3
0,13,12,6""")

# ---- group: KIT
xz_plane = XZPlane(Origin=Point(0, 0, 0))
panel_39 = Panel("3")
panel_40 = Panel("2")
panel_41 = Panel("15.6")
rectangle_2 = Rectangle(Plane=xz_plane, XSize="1.5", YSize="1.5", Radius=0)  # -> Rectangle, Length
unit_x_4 = UnitX(Factor="15.85")
move_19 = Move(Geometry=rectangle_2.Rectangle, Motion=unit_x_4)  # -> Geometry, Transform
unit_z_10 = UnitZ(Factor="1")
window_wall = Move(Geometry=move_19.Geometry, Motion=unit_z_10)  # -> Geometry, Transform

# ----
text_split_2 = TextSplit(Text=verify, Separators=",")  # -> simplify(Result)
panel_42 = Panel(text_split_2)
tree_branch_27 = TreeBranch(Tree=panel_42, Path=Slider(0, range=0..19), MaintainPaths=True)

# ---- group: VISUALIZATION
# Run this to start creating data through optimisation!
galapagos = Galapagos()

# ----
panel_43 = Panel(tree_branch_27)
range = Range(Domain="0 to 19", Steps="19")  # -> simplify(Range)
range_2 = Range(Domain="0 to 249", Steps="249")  # -> simplify(Range)
range_3 = Range(Domain="0 to 180", Steps="12")  # -> simplify(Range)
verify_index = Panel(range)
iteration = Panel(range_2)
orientation = Panel(range_3)
colibri_inputs_iterator = ColibriInputsIterator(Orientation=orientation, Iteration=iteration, ignoreAllWarningMsg=True)  # -> Unique_Name, Inputs, Orientation, Iteration, Verify_index, V_N
rotate = Rotate(Geometry=all_edges, Angle=degrees(colibri_inputs_iterator.Orientation), Plane=PlaneXY(0, 0, 0))  # -> Geometry, Transform
item_2 = ListItem(List=python_5.options, Index=colibri_inputs_iterator.Iteration, Wrap=True)  # -> simplify(Item)
curve = Curve(rotate.Geometry)
python_6 = GhPythonScript(x=item_2)  # -> out, flatten(a)
# ---------- python_6: Python ----------
__author__ = "tamk"
__version__ = "2024.03.25"

import rhinoscriptsyntax as rs

a=x
# ---------- end python_6 ----------
panel_44 = Panel(python_6.a)
list_item_48 = ListItem(List=list_indices_2, Index=panel_44, Wrap=True)
tree_branch_28 = TreeBranch(Tree=panel_38, Path=list_item_48, MaintainPaths=True)
panel_binary = Panel(tree_branch_28)
list_indices_3 = ListIndices(List=panel_binary)
sort_list_2 = SortList(Keys=panel_binary, ValuesValuesA=list_indices_3)  # -> Keys, ValuesValuesA
panel_45 = Panel(sort_list_2.ValuesValuesA)
_4_panels = ListItem(List=panel_45, Index=["16", "17", "18", "19"], Wrap=True)
ghpython_script = GhPythonScript(label="Verify Index")  # -> flattened_labels; inputs data: list
# ---------- ghpython_script: Python ----------
__author__ = "tamk"
__version__ = "2024.04.04"

import rhinoscriptsyntax as rs



if label:
    flattened_labels = ["{}_{}".format(label, _i_v) for _i_v, _v in enumerate(data)]
# ---------- end ghpython_script ----------
ghpython_script_2 = GhPythonScript(label="Orientation", data=colibri_inputs_iterator.Orientation)  # -> flattened_labels; inputs data: list; same code as ghpython_script

# ---- group: VISUALIZATION / Turn on this to start recording; rewrites over file
boolean_toggle = BooleanToggle(False)

boolean_toggle_2 = BooleanToggle(False)

# ---- group: VISUALIZATION
# Example Assumes:
# 
# 2 Variables: x,y
# 1 Objective: z
# LOGGING DATA
# Method #1
# (1) Generate variable combination
# (2) Use animate to try combo one at a time
# (3) Log combo accordingly
# List of Data Points
# Variable x
# [Design Pipeline
# Placeholder]
# Generate a bunch of variable combinations
# List of Data Points
# Variable y
# Create header row of csv spreadsheet,
# containing names of the columns
# Merge data
# Toggle to 'True'
# and then animate slider...
# [Design Evaluation
# Placeholder]
# Method #2
# (1) Use optimisation
# (2) Each time a design variable changed,
# a data point is added to csv
# Variable x
# [Design Pipeline
# Placeholder]
# Variable y
# Create header row of csv spreadsheet,
# containing names of the columns
# Merge data
# Toggle to 'True'
# and then animate slider...
# [Design Evaluation
# Placeholder]
# LOADING DATA
# Extract columns
# Check the names...
# QUICK VISUALISATION
# AS 2D SURFACE
# Connect 'content' to CSV String
# Data in this case is 3D:
# We can treat it as points...
# Replace with 'data.csv'
# Create a mesh to interpolate the points...
# Colour mesh based on objective (z)
# Remove potential duplicates
number_slider_3 = Slider(10, range=0..10)
range_4 = Range(Domain="-2 to 2", Steps=number_slider_3)
read_file_2 = ReadFile(File="\data.csv", PerLineParse=True)
cross_reference = CrossReference(ListListA=range_4, ListListB=range_4, CrossMode=1)  # -> ListListA, ListListB
data_4 = Data(read_file_2)
data_5 = Data(cross_reference.ListListB)
data_6 = Data(cross_reference.ListListA)
data_7 = Data(["in:X component,in:Y component,out:Z component,img", "-1.6,-2,6.56,Xcomponent-1.6_Ycomponent-2.png", "-0.8,-2,4.64,Xcomponent-0.8_Ycomponent-2.png", "-0.4,-2,4.16,Xcomponent-0.4_Ycomponent-2.png", "0,-2,4,Xcomponent0_Ycomponent-2.png", "0.4,-2,4.16,Xcomponent0.4_Ycomponent-2.png"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])
panel_46 = Panel(data_7)
read_csv = ReadCSV(CSVString=data_7, Delimiter=",")  # -> Headers, Values
panel_47 = Panel(read_csv.Headers)
data_8 = Data(read_csv.Values)
flip_matrix = FlipMatrix(Data=data_8)
list_item_49 = ListItem(List=flip_matrix, Index="0", Wrap=True)
list_item_50 = ListItem(List=flip_matrix, Index="1", Wrap=True)
list_item_51 = ListItem(List=flip_matrix, Index="2", Wrap=True)
int_4 = Integer(number_slider_2)
number = Number(list_item_50)
number_2 = Number(list_item_51)
number_3 = Number(list_item_49)
data_9 = Data(data_5)
data_10 = Data(data_6)
list_item_52 = ListItem(List=data_10, Index=int_4, Wrap=True)
list_item_53 = ListItem(List=data_9, Index=int_4, Wrap=True)
construct_point_7 = ConstructPoint(XCoordinate=number_3, YCoordinate=number, ZCoordinate=number_2)
data_11 = Data(Slider(0, range=-2..2))
data_12 = Data(Slider(0, range=-2..2))
data_13 = Data(list_item_52)
data_14 = Data(list_item_53)
point = Point(flatten(construct_point_7))
remove_duplicate_points_karamba3d = RemoveDuplicatePointsKaramba3D(Point=point, LimitDistance=0.005)  # -> OutPoint, Info, Indexes
point_2 = Point(flatten(remove_duplicate_points_karamba3d.OutPoint))
deconstruct = Deconstruct(Point=point_2)  # -> XComponent, YComponent, ZComponent
expression = Expression(x=data_11, y=data_12, Expression="x² + y²")
number_4 = Number(flatten(deconstruct.ZComponent))
expression_2 = Expression(x=data_13, y=data_14, Expression="x² + y²")
bounds = Bounds(Numbers=number_4)
data_15 = Data(expression)
delaunay_mesh = DelaunayMesh(Points=point_2, Plane=PlaneXY(0, 0, 0))
data_16 = Data(expression_2)
deconstruct_domain = DeconstructDomain(Domain=bounds)  # -> Start, End
min = Panel(deconstruct_domain.Start)
max = Panel(deconstruct_domain.End)
deconstruct_mesh = DeconstructMesh(Mesh=delaunay_mesh)  # -> Vertices, Faces, Colours, Normals
gradient_2 = Gradient(
    LowerLimit=min,
    UpperLimit=max,
    Parameter=deconstruct.ZComponent,
    stops=[0: RGB(234, 38, 0), 0.25: RGB(234, 126, 0), 0.5: RGB(254, 244, 84), 0.75: RGB(173, 203, 249), 1: RGB(75, 107, 169)])
merge = Merge(Data1=data_11, Data2=data_12)
construct_mesh = ConstructMesh(Vertices=deconstruct_mesh.Vertices, Faces=deconstruct_mesh.Faces, Colours=gradient_2)
merge_2 = Merge(Data1=data_13, Data2=data_14)
data_17 = Data(data_15)
data_18 = Data(merge)
panel_48 = Panel("""x
y
z""")
data_19 = Data(data_16)
merge_3 = Merge(Data1=data_18, Data2=data_17)
data_20 = Data(merge_2)
panel_49 = Panel("""x
y
z""")
merge_4 = Merge(Data1=data_20, Data2=data_19)
data_21 = Data(flatten(merge_3))
data_22 = Data(flatten(merge_4))
ghpython_script_3 = GhPythonScript(filepath="C:/test_data/data_log_test.csv", head=panel_48, data=data_21, write=boolean_toggle, reset=Button())  # -> out, a; inputs head: list, data: list
# ---------- ghpython_script_3: Python ----------
__author__ = "tamk"
__version__ = "2024.04.04"

import rhinoscriptsyntax as rs
from scriptcontext import sticky
import os
import sys


if reset:
    _ = sticky.pop('filestream', {})
    
fs = sticky.setdefault('filestream', None)

if not fs and filepath and write:
    fs = sticky['filestream'] = open(filepath, 'w')
    if head:
        fs.write(','.join(str(_h) for _h in head) + '\n')
    
if fs and write:
    fs.write(','.join(str(_x) for _x in data) + '\n')
    fs.flush()

if fs and not write:
    fs.close()
    fs = sticky['filestream'] = None
# ---------- end ghpython_script_3 ----------
ghpython_script_4 = GhPythonScript(filepath="C:/test_data/data_log_test.csv", head=panel_49, data=data_22, write=boolean_toggle_2, reset=Button())  # -> out, a; inputs head: list, data: list; same code as ghpython_script_3

# ----
range_5 = Range(Domain="0 to 360", Steps="8")
range_6 = Range(Domain="0 to 499", Steps="499")
orientation_2 = Panel(range_5)
index = Panel(range_6)
colibri_outputs = ColibriOutputs()
colibri_inputs_iterator_2 = ColibriInputsIterator(Index=simplify(index), ignoreAllWarningMsg=True)  # -> Unique_Name, Inputs, simplify(Index), Orientation, V_N
panel_50 = Panel("C://WINDOWSFINAL")
# (optional) Represents global data that does not change with animate...
# Assemble 'header' row of data table...
# Random generated data...
# One data point is picked at each iteration of 'animate'...
# Creating data labels for 'header' row...
# List of values...
# Flatten points/vectors...
# Assemble 'data' of data table
colibri_aggregator = ColibriAggregator(
    Folder="c:\Colibri",
    Inputs=colibri_inputs_iterator_2.Inputs,
    Outputs=colibri_outputs,
    Write=Toggle(False),
    recordingMode=0)

# ---- group: DAYLIGHT ANALYSIS
# Annual DA >150 lux
# at least 40% of 9am-5pm
# (Orientation)
# Annual DA >150 lux
# at least 40% of 9am-5pm
# (Window placement)
surface_5 = Surface([cluster.curve_4, cluster.curve_2, cluster.curve, cluster.curve_3])  # disabled
brep_4 = Brep(cluster.result)  # disabled
rotate_room = Rotate(Geometry=brep_4, Angle=degrees(colibri_inputs_iterator.Orientation), Plane=PlaneXY(0, 0, 0))  # -> Geometry, Transform; disabled
room = BrepJoin(Breps=flatten(rotate_room.Geometry))  # -> Breps, Closed; disabled
number_slider_4 = Slider(0.1, range=0..0.5)  # disabled
roomsolid = HBRoomFromSolid(geo=flatten(room.Breps), conditioned=True)  # -> out, rooms; disabled; plug-in component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
colour_swatch = ColourSwatch(SwatchColor=RGB(255, 255, 255))  # disabled
number_slider_5 = Slider(1, range=0..1)  # disabled
number_slider_6 = Slider(0.7, range=0..1)  # disabled
panel_51 = Panel("https://energyplus-weather.s3.amazonaws.com/europe_wmo_region_6/SYR/SYR_Damascus.400800_IWEC/SYR_Damascus.400800_IWEC.zip")  # disabled
downloadepw = LBDownloadWeather(weather_URL=panel_51)  # -> epw_file, stat_file, ddy_file; disabled; plug-in component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
number_slider_7 = Slider(0.3, range=0..1)  # disabled
number_slider_8 = Slider(0, range=-360..360)  # disabled
wea = HBWeaFromEPW(epw_file=downloadepw.epw_file)  # -> wea; disabled; plug-in component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
number_slider_9 = Slider(1, range=0..24)  # disabled
constantschedule = HBConstantSchedule(values=number_slider_9)  # -> out, schedule, idf_text; disabled; plug-in component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
number_slider_10 = Slider(100, range=0..100)  # disabled
number_slider_11 = Slider(0, range=0..100)  # disabled
boolean_toggle_3 = BooleanToggle(True)  # disabled
number_slider_12 = Slider(0, range=0..100)  # disabled
panel_52 = Panel("-t 150")  # disabled
legendpar = LBLegendParameters(min=number_slider_11, max=number_slider_10, num_decimals=number_slider_12)  # -> leg_par; disabled; plug-in component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
number_slider_13 = Slider(40, range=0..100)  # disabled
panel_53 = Panel("%")  # disabled
panel_54 = Panel("70")  # disabled
panel_55 = Panel("-25")  # disabled
panel_56 = Panel("15")  # disabled
panel_57 = Panel("20")  # disabled
panel_58 = Panel("-15")  # disabled
panel_59 = Panel("-20")  # disabled
construct_point_8 = ConstructPoint(XCoordinate=panel_55, YCoordinate=panel_54, ZCoordinate=0)  # disabled
construct_point_9 = ConstructPoint(XCoordinate=panel_58, YCoordinate=panel_56, ZCoordinate=0)  # disabled
construct_point_10 = ConstructPoint(XCoordinate=panel_59, YCoordinate=panel_57, ZCoordinate=0)  # disabled
panel_60 = Panel("""Original window
placement performance
(x orientation and lux)""")  # disabled
colour_swatch_2 = ColourSwatch(SwatchColor=RGB(0, 0, 0))  # disabled
panel_61 = Panel("% of Total Area")  # disabled
area_2 = TextTag(Location=construct_point_8, Text=panel_60, Colour=colour_swatch_2)  # disabled
area_3 = TextTag(Location=construct_point_10, Text=panel_61, Colour=colour_swatch_2)  # disabled

# ---- group: PANEL GENERATOR
python_7 = GhPythonScript()  # -> out, options
# ---------- python_7: Python ----------
__author__ = "tamk"
__version__ = "2024.03.25"

from random import randint
import rhinoscriptsyntax as rs

n_panels = 19
n_windows = 4
n_options = 3000

options = set()

while(True):
    _option = set()
    
    while(True):
        _ind = randint(0, n_panels)
        if _ind not in _option:
            _option.add(_ind)
        if len(_option) == n_windows:
            break
            
    _option = tuple(_option)
    
    if _option not in options:
        options.add(_option)
        
    if len(options) == n_options:
        break

print(options)
# ---------- end python_7 ----------
internalized = Data(["Grasshopper.Kernel.Types.GH_ObjectWrapper", "Grasshopper.Kernel.Types.GH_ObjectWrapper", "Grasshopper.Kernel.Types.GH_ObjectWrapper", "Grasshopper.Kernel.Types.GH_ObjectWrapper", "Grasshopper.Kernel.Types.GH_ObjectWrapper", "Grasshopper.Kernel.Types.GH_ObjectWrapper"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])
item_3 = ListItem(List=python_7.options, Index=Slider(1224, range=0..2999), Wrap=True)  # -> simplify(Item)
# DAYLIGHT ANALYSIS
panel_62 = Panel(ordered_panels)
python_8 = GhPythonScript(x=item_3)  # -> out, flatten(a); same code as python_6
list_indices_4 = ListIndices(List=panel_62)
panel_63 = Panel(python_8.a)
replace_items = ReplaceItems(List=list_indices_4, Item="0", Indices=list_indices_4, Wrap=False)
replace_items_2 = ReplaceItems(List=replace_items, Item="1", Indices=panel_63, Wrap=False)  # -> flatten(List)
panel_binary_2 = Panel(replace_items_2)
list_item_54 = ListItem(List=ordered_panels, Index=panel_3, Wrap=True)
plain_wall = Surface(cluster.geometry)
map_to_surface = MapToSurface(Curve=window_wall.Geometry, Source=plain_wall, Target=list_item_54)
rotate_2 = Rotate(Geometry=list_item_54, Angle=degrees(colibri_inputs_iterator.Orientation), Plane=PlaneXY(0, 0, 0))  # -> Geometry, Transform
surface_6 = Surface(rotate_2.Geometry)

# ---- group: DAYLIGHT ANALYSIS (continued)
surface_7 = Surface(map_to_surface)  # disabled
merge_5 = Merge(Data1=surface_7, Data2=surface_5)  # disabled
brep_5 = Brep(merge_5)  # disabled
rotate_windows = Rotate(Geometry=brep_5, Angle=degrees(colibri_inputs_iterator.Orientation), Plane=PlaneXY(0, 0, 0))  # -> Geometry, Transform; disabled
geometry = Geometry(rotate_windows.Geometry)  # disabled
aperture = HBAperture(geo=geometry)  # -> out, apertures; disabled; plug-in component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
bordershades = HBExtrudedBorderShades(hb_objs=flatten(aperture.apertures), depth=number_slider_4)  # -> out, hb_objs; disabled; plug-in component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
addsubface = HBAddSubface(hb_obj=flatten(roomsolid.rooms), sub_faces=flatten(bordershades.hb_objs))  # -> hb_obj; disabled; plug-in component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
model = HBModel(rooms=flatten(addsubface))  # -> out, model; disabled; plug-in component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
vizbytype = HBVisualizeByType(hb_objs=model.model)  # -> walls, interior_walls, roofs, ceilings, exterior_floors, interior_floors, air_walls, apertures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; disabled; plug-in component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
vizwiref = HBVisualizeWireframe(hb_objs=flatten(model.model))  # -> geo; disabled; plug-in component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
area_4 = Area(Geometry=vizbytype.exterior_floors)  # -> Area, Centroid; disabled
custom_preview = CustomPreview(Geometry=vizwiref, Material=colour_swatch)  # disabled
gridrooms = HBSensorGridFromRooms(rooms=model.model, grid_size=number_slider_5, dist_floor=number_slider_6)  # -> grid, points, mesh; disabled; plug-in component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
point_3 = Point(gridrooms.points)  # disabled
point_list = PointList(Points=point_3, Size=number_slider_7)  # disabled
mesh_join = MeshJoin(Meshes=gridrooms.mesh)  # disabled
assigngridsviews = HBAssignGridsAndViews(model=model.model, grids=flatten(gridrooms.grid))  # -> model; disabled; plug-in component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
annualdaylight = HBAnnualDaylight(
    model=assigngridsviews,
    wea=wea,
    north=number_slider_8,
    thresholds=panel_52,
    schedule=constantschedule.schedule,
    run=boolean_toggle_3)  # -> out, results, DA, cDA, UDI, UDI_low, UDI_up; disabled; plug-in component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
da_sensor = Data(flatten(annualdaylight.DA))  # disabled
heatmap = LBSpatialHeatmap(values=da_sensor, mesh=mesh_join, legend_par=legendpar, legend_title=panel_53)  # -> mesh, legend, title, colors, legend_par, vis_set; disabled; plug-in component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
meshselector = LBMeshThresholdSelector(values=da_sensor, mesh=heatmap.mesh, abs_threshold=number_slider_13)  # -> out, total_value, total_area, sub_mesh, outline; disabled; plug-in component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
mesh_3 = Mesh(heatmap.mesh)  # disabled
geometry_2 = Geometry(heatmap.legend)  # disabled
panel_64 = Panel(meshselector.total_area)  # disabled
score = Division(A=meshselector.total_area)  # disabled
panel_65 = Panel(score)  # disabled
area_5 = TextTag(Location=construct_point_9, Text=panel_65, Colour=colour_swatch_2)  # disabled

# ---- group: PANEL GENERATOR (continued)
mass_addition = MassAddition(Input=da_sensor)  # -> Result, PartialResults
list_length = ListLength(List=da_sensor)
division = Division(A=mass_addition.Result, B=list_length)
average_sensor = Panel(division)

# ---- group: WRITE CSV
# CHECKLIST: CHECK BEFORE FLYING:
# - White BG shaded viewport
# - Correct empty folder
# - Feet unit recomputed
# - Update text tags and lux threshold
# - Panel numbers match
# - Colibri inputs and outputs and their names
# - Check everything you want is previewed
# - Set write? to true
panel_66 = Panel("Panel")
data_23 = Data(panel_binary)
data_24 = Data(da_sensor)
ghpython_script_5 = GhPythonScript(label=panel_66, data=data_23)  # -> flattened_labels; inputs data: list; same code as ghpython_script
ghpython_script_6 = GhPythonScript(label="Sensor", data=data_24)  # -> flattened_labels; inputs data: list; same code as ghpython_script
ghpython_script_7 = GhPythonScript(label="Average Sensor", data=division)  # -> flattened_labels; inputs data: list; same code as ghpython_script
ghpython_script_8 = GhPythonScript(label="% of Total Area", data=score)  # -> flattened_labels; inputs data: list; same code as ghpython_script
merge_6 = Merge(
    Data1=ghpython_script_5,
    Data2=ghpython_script_6,
    Data3=ghpython_script_7,
    Data4=ghpython_script_8,
    Data5=ghpython_script_2)  # -> flatten(Result)
panel_67 = Panel(merge_6)

# ---- group: WRITE CSV / add da percentage to D3
merge_7 = Merge(Data1=data_23, Data2=data_24, Data3=division, Data4=score, Data5=colibri_inputs_iterator.Orientation)  # -> flatten(Result)

# ---- group: WRITE CSV (continued)
panel_68 = Panel(merge_7)
ghpython_script_9 = GhPythonScript(filepath="\\Mac\Home\Desktop\FINALORIENTATION.csv", head=panel_67, data=panel_68, write=Toggle(False), reset=Button())  # -> out, a; inputs head: list, data: list; disabled; same code as ghpython_script_3

# ==== cluster Cluster
kit = Kit()  # -> geometry_3, unit_vector_2, geometry, unit_vector, geometry_2
geometry = ClusterOutput(kit.geometry_2)
build = Build()  # -> surface, surface_2, surface_3, surface_4, plane, plane_2, plane_3, plane_4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
result = ClusterOutput(build.result_3)
divide_surface = DivideSurface(Surface=build.plane, UCount=Slider(6, range=0..6), VCount=Slider(1, range=0..1))  # -> simplify(Points), Normals, Parameters
divide_surface_2 = DivideSurface(Surface=build.plane_4, UCount=Slider(6, range=0..6), VCount=Slider(1, range=0..1))  # -> simplify(Points), Normals, Parameters
divide_surface_3 = DivideSurface(Surface=build.surface_4, UCount=Slider(6, range=0..6), VCount=Slider(1, range=0..1))  # -> simplify(Points), Normals, Parameters
divide_surface_4 = DivideSurface(Surface=build.plane_2, UCount=Slider(4, range=0..6), VCount=Slider(1, range=0..1))  # -> simplify(Points), Normals, Parameters
divide_surface_5 = DivideSurface(Surface=build.plane_3, UCount=Slider(4, range=0..6), VCount=Slider(1, range=0..1))  # -> simplify(Points), Normals, Parameters
divide_surface_6 = DivideSurface(Surface=build.surface_3, UCount=Slider(6, range=0..6), VCount=Slider(1, range=0..1))  # -> simplify(Points), Normals, Parameters
flip_matrix = FlipMatrix(Data=divide_surface_2.Points)
flip_matrix_2 = FlipMatrix(Data=divide_surface.Points)
flip_matrix_3 = FlipMatrix(Data=divide_surface_3.Points)
flip_matrix_4 = FlipMatrix(Data=divide_surface_4.Points)
flip_matrix_5 = FlipMatrix(Data=divide_surface_5.Points)
flip_matrix_6 = FlipMatrix(Data=divide_surface_6.Points)
split_tree = SplitTree(Data=flip_matrix, Masks=flatten("{0}"))  # -> Positive, Negative
split_tree_2 = SplitTree(Data=flip_matrix_2, Masks=flatten("{0}"))  # -> Positive, Negative
split_tree_3 = SplitTree(Data=flip_matrix_3, Masks=flatten("{0}"))  # -> Positive, Negative
split_tree_4 = SplitTree(Data=flip_matrix_4, Masks=flatten("{0}"))  # -> Positive, Negative
split_tree_5 = SplitTree(Data=flip_matrix_6, Masks=flatten("{0}"))  # -> Positive, Negative
split_tree_6 = SplitTree(Data=flip_matrix_5, Masks=flatten("{0}"))  # -> Positive, Negative
line = Line(StartPoint=split_tree.Positive, EndPoint=split_tree.Negative)
line_2 = Line(StartPoint=split_tree_2.Positive, EndPoint=split_tree_2.Negative)
line_3 = Line(StartPoint=reverse([build.i_2, build.i_3]), EndPoint=build.i)
line_4 = Line(StartPoint=split_tree_3.Positive, EndPoint=split_tree_3.Negative)
line_5 = Line(StartPoint=split_tree_4.Positive, EndPoint=split_tree_4.Negative)
line_6 = Line(StartPoint=split_tree_5.Positive, EndPoint=split_tree_5.Negative)
line_7 = Line(StartPoint=split_tree_6.Positive, EndPoint=split_tree_6.Negative)
surface_split = SurfaceSplit(Surface=build.plane_4, Curves=line)  # -> flatten(Fragments)
surface_split_2 = SurfaceSplit(Surface=build.plane, Curves=line_2)  # -> flatten(Fragments)
surface_split_3 = SurfaceSplit(Surface=build.surface_3, Curves=line_6)  # -> flatten(Fragments)
surface_split_4 = SurfaceSplit(Surface=build.plane_3, Curves=line_7)  # -> flatten(Fragments)
surface_split_5 = SurfaceSplit(Surface=[build.surface, build.surface_2], Curves=line_3)  # -> flatten(Fragments)
surface_split_6 = SurfaceSplit(Surface=build.surface_4, Curves=line_4)  # -> flatten(Fragments)
surface_split_7 = SurfaceSplit(Surface=build.plane_2, Curves=line_5)  # -> flatten(Fragments)
list_item = ListItem(List=surface_split, Index=Slider(0, range=0..5), Wrap=True)
list_item_2 = ListItem(List=surface_split, Index=Slider(4, range=0..5), Wrap=True)
list_item_3 = ListItem(List=surface_split, Index=Slider(1, range=0..5), Wrap=True)
list_item_4 = ListItem(List=surface_split, Index=Slider(2, range=0..5), Wrap=True)
list_item_5 = ListItem(List=surface_split, Index=Slider(3, range=0..5), Wrap=True)
list_item_6 = ListItem(List=surface_split, Index=Slider(5, range=0..5), Wrap=True)
list_item_7 = ListItem(List=surface_split_2, Index=Slider(0, range=0..5), Wrap=True)
list_item_8 = ListItem(List=surface_split_2, Index=Slider(1, range=0..5), Wrap=True)
list_item_9 = ListItem(List=surface_split_2, Index=Slider(2, range=0..5), Wrap=True)
list_item_10 = ListItem(List=surface_split_2, Index=Slider(3, range=0..5), Wrap=True)
list_item_11 = ListItem(List=surface_split_2, Index=Slider(4, range=0..5), Wrap=True)
list_item_12 = ListItem(List=surface_split_2, Index=Slider(5, range=0..5), Wrap=True)
list_item_13 = ListItem(List=surface_split_4, Index=Slider(0, range=0..3), Wrap=True)
list_item_14 = ListItem(List=surface_split_4, Index=Slider(1, range=0..3), Wrap=True)
list_item_15 = ListItem(List=surface_split_4, Index=Slider(2, range=0..3), Wrap=True)
list_item_16 = ListItem(List=surface_split_4, Index=Slider(3, range=0..3), Wrap=True)
list_item_17 = ListItem(List=surface_split_7, Index=Slider(0, range=0..3), Wrap=True)
list_item_18 = ListItem(List=surface_split_7, Index=Slider(1, range=0..3), Wrap=True)
list_item_19 = ListItem(List=surface_split_7, Index=Slider(2, range=0..3), Wrap=True)
list_item_20 = ListItem(List=surface_split_7, Index=Slider(3, range=0..3), Wrap=True)
list_item_21 = ListItem(List=surface_split_5, Index=Slider(0, range=0..3), Wrap=True)
list_item_22 = ListItem(List=surface_split_5, Index=Slider(1, range=0..3), Wrap=True)
list_item_23 = ListItem(List=surface_split_5, Index=Slider(2, range=0..3), Wrap=True)
list_item_24 = ListItem(List=surface_split_5, Index=Slider(3, range=0..3), Wrap=True)
mesh_edges = MeshEdges(Mesh=list_item_5)  # -> NakedEdges, InteriorEdges, NonManifoldEdges
mesh_edges_2 = MeshEdges(Mesh=list_item_3)  # -> NakedEdges, InteriorEdges, NonManifoldEdges
mesh_edges_3 = MeshEdges(Mesh=list_item)  # -> NakedEdges, InteriorEdges, NonManifoldEdges
mesh_edges_4 = MeshEdges(Mesh=list_item_4)  # -> NakedEdges, InteriorEdges, NonManifoldEdges
mesh_edges_5 = MeshEdges(Mesh=list_item_2)  # -> NakedEdges, InteriorEdges, NonManifoldEdges
mesh_edges_6 = MeshEdges(Mesh=list_item_6)  # -> NakedEdges, InteriorEdges, NonManifoldEdges
mesh_edges_7 = MeshEdges(Mesh=list_item_8)  # -> NakedEdges, InteriorEdges, NonManifoldEdges
mesh_edges_8 = MeshEdges(Mesh=list_item_7)  # -> NakedEdges, InteriorEdges, NonManifoldEdges
mesh_edges_9 = MeshEdges(Mesh=list_item_9)  # -> NakedEdges, InteriorEdges, NonManifoldEdges
mesh_edges_10 = MeshEdges(Mesh=list_item_10)  # -> NakedEdges, InteriorEdges, NonManifoldEdges
mesh_edges_11 = MeshEdges(Mesh=list_item_12)  # -> NakedEdges, InteriorEdges, NonManifoldEdges
mesh_edges_12 = MeshEdges(Mesh=list_item_11)  # -> NakedEdges, InteriorEdges, NonManifoldEdges
mesh_edges_13 = MeshEdges(Mesh=list_item_14)  # -> NakedEdges, InteriorEdges, NonManifoldEdges
mesh_edges_14 = MeshEdges(Mesh=list_item_15)  # -> NakedEdges, InteriorEdges, NonManifoldEdges
mesh_edges_15 = MeshEdges(Mesh=list_item_16)  # -> NakedEdges, InteriorEdges, NonManifoldEdges
mesh_edges_16 = MeshEdges(Mesh=list_item_21)  # -> NakedEdges, InteriorEdges, NonManifoldEdges
mesh_edges_17 = MeshEdges(Mesh=list_item_17)  # -> NakedEdges, InteriorEdges, NonManifoldEdges
mesh_edges_18 = MeshEdges(Mesh=list_item_22)  # -> NakedEdges, InteriorEdges, NonManifoldEdges
mesh_edges_19 = MeshEdges(Mesh=list_item_24)  # -> NakedEdges, InteriorEdges, NonManifoldEdges
mesh_edges_20 = MeshEdges(Mesh=list_item_13)  # -> NakedEdges, InteriorEdges, NonManifoldEdges
mesh_edges_21 = MeshEdges(Mesh=list_item_18)  # -> NakedEdges, InteriorEdges, NonManifoldEdges
mesh_edges_22 = MeshEdges(Mesh=list_item_23)  # -> NakedEdges, InteriorEdges, NonManifoldEdges
mesh_edges_23 = MeshEdges(Mesh=list_item_20)  # -> NakedEdges, InteriorEdges, NonManifoldEdges
mesh_edges_24 = MeshEdges(Mesh=list_item_19)  # -> NakedEdges, InteriorEdges, NonManifoldEdges
naked_edges = ClusterOutput(mesh_edges.NakedEdges)
naked_edges_2 = ClusterOutput(mesh_edges_2.NakedEdges)
naked_edges_3 = ClusterOutput(mesh_edges_3.NakedEdges)
naked_edges_4 = ClusterOutput(mesh_edges_4.NakedEdges)
naked_edges_5 = ClusterOutput(mesh_edges_5.NakedEdges)
naked_edges_6 = ClusterOutput(mesh_edges_6.NakedEdges)
naked_edges_7 = ClusterOutput(mesh_edges_7.NakedEdges)
naked_edges_8 = ClusterOutput(mesh_edges_8.NakedEdges)
naked_edges_9 = ClusterOutput(mesh_edges_9.NakedEdges)
naked_edges_10 = ClusterOutput(mesh_edges_10.NakedEdges)
naked_edges_11 = ClusterOutput(mesh_edges_11.NakedEdges)
naked_edges_12 = ClusterOutput(mesh_edges_12.NakedEdges)
naked_edges_13 = ClusterOutput(mesh_edges_13.NakedEdges)
naked_edges_14 = ClusterOutput(mesh_edges_14.NakedEdges)
naked_edges_15 = ClusterOutput(mesh_edges_15.NakedEdges)
naked_edges_16 = ClusterOutput(mesh_edges_16.NakedEdges)
naked_edges_17 = ClusterOutput(mesh_edges_17.NakedEdges)
naked_edges_18 = ClusterOutput(mesh_edges_18.NakedEdges)
naked_edges_19 = ClusterOutput(mesh_edges_19.NakedEdges)
naked_edges_20 = ClusterOutput(mesh_edges_20.NakedEdges)
naked_edges_21 = ClusterOutput(mesh_edges_21.NakedEdges)
naked_edges_22 = ClusterOutput(mesh_edges_22.NakedEdges)
naked_edges_23 = ClusterOutput(mesh_edges_23.NakedEdges)
naked_edges_24 = ClusterOutput(mesh_edges_24.NakedEdges)
unit_y = UnitY(Factor="3.1")
unit_y_2 = UnitY(Factor="-3.1")
unit_y_3 = UnitY(Factor="3.1")
move = Move(Geometry=mesh_edges.NakedEdges, Motion=unit_y)  # -> Geometry, Transform
unit_x = UnitX(Factor="2.725")
move_2 = Move(Geometry=mesh_edges_6.NakedEdges, Motion=unit_y_2)  # -> Geometry, Transform
unit_x_2 = UnitX(Factor="-2.725")
unit_x_3 = UnitX(Factor="2.725")
move_3 = Move(Geometry=mesh_edges_10.NakedEdges, Motion=unit_y_3)  # -> Geometry, Transform
move_4 = Move(Geometry=mesh_edges_13.NakedEdges, Motion=unit_x)  # -> Geometry, Transform
move_5 = Move(Geometry=mesh_edges_23.NakedEdges, Motion=unit_x_2)  # -> Geometry, Transform
move_6 = Move(Geometry=mesh_edges_21.NakedEdges, Motion=unit_x_3)  # -> Geometry, Transform
bugged = BoundarySurfaces(Edges=move_3.Geometry)
boundary_surfaces = BoundarySurfaces(Edges=mesh_edges_20.NakedEdges)
boundary_surfaces_2 = BoundarySurfaces(Edges=mesh_edges_13.NakedEdges)
bugged_2 = BoundarySurfaces(Edges=move_4.Geometry)
bugged_3 = BoundarySurfaces(Edges=move.Geometry)
boundary_surfaces_3 = BoundarySurfaces(Edges=mesh_edges_7.NakedEdges)
boundary_surfaces_4 = BoundarySurfaces(Edges=mesh_edges_15.NakedEdges)
boundary_surfaces_5 = BoundarySurfaces(Edges=mesh_edges_11.NakedEdges)
boundary_surfaces_6 = BoundarySurfaces(Edges=mesh_edges_9.NakedEdges)
boundary_surfaces_7 = BoundarySurfaces(Edges=mesh_edges.NakedEdges)
boundary_surfaces_8 = BoundarySurfaces(Edges=mesh_edges_10.NakedEdges)
bugged_4 = BoundarySurfaces(Edges=move_2.Geometry)
boundary_surfaces_9 = BoundarySurfaces(Edges=mesh_edges_21.NakedEdges)
boundary_surfaces_10 = BoundarySurfaces(Edges=mesh_edges_2.NakedEdges)
boundary_surfaces_11 = BoundarySurfaces(Edges=mesh_edges_4.NakedEdges)
boundary_surfaces_12 = BoundarySurfaces(Edges=mesh_edges_23.NakedEdges)
boundary_surfaces_13 = BoundarySurfaces(Edges=mesh_edges_16.NakedEdges)
boundary_surfaces_14 = BoundarySurfaces(Edges=mesh_edges_18.NakedEdges)
boundary_surfaces_15 = BoundarySurfaces(Edges=mesh_edges_22.NakedEdges)
boundary_surfaces_16 = BoundarySurfaces(Edges=mesh_edges_19.NakedEdges)
bugged_5 = BoundarySurfaces(Edges=move_5.Geometry)
boundary_surfaces_17 = BoundarySurfaces(Edges=mesh_edges_8.NakedEdges)
boundary_surfaces_18 = BoundarySurfaces(Edges=mesh_edges_6.NakedEdges)
bugged_6 = BoundarySurfaces(Edges=move_6.Geometry)
surfaces = ClusterOutput(bugged)
surfaces_2 = ClusterOutput(boundary_surfaces)
surfaces_3 = ClusterOutput(boundary_surfaces_2)
surfaces_4 = ClusterOutput(bugged_2)
surfaces_5 = ClusterOutput(bugged_3)
surfaces_6 = ClusterOutput(boundary_surfaces_3)
surfaces_7 = ClusterOutput(boundary_surfaces_4)
surfaces_8 = ClusterOutput(boundary_surfaces_5)
surfaces_9 = ClusterOutput(boundary_surfaces_6)
surfaces_10 = ClusterOutput(boundary_surfaces_7)
surfaces_11 = ClusterOutput(boundary_surfaces_8)
surfaces_12 = ClusterOutput(bugged_4)
surfaces_13 = ClusterOutput(boundary_surfaces_9)
surfaces_14 = ClusterOutput(boundary_surfaces_10)
surfaces_15 = ClusterOutput(boundary_surfaces_11)
surfaces_16 = ClusterOutput(boundary_surfaces_12)
surfaces_17 = ClusterOutput(bugged_5)
surfaces_18 = ClusterOutput(boundary_surfaces_17)
surfaces_19 = ClusterOutput(boundary_surfaces_18)
surfaces_20 = ClusterOutput(bugged_6)
unit_x_4 = UnitX(Factor="27")
unit_x_5 = UnitX(Factor="25")
right_window_triangle = Move(Geometry=kit.geometry, Motion=kit.unit_vector)  # -> Geometry, Transform
left_window_triangle = Move(Geometry=kit.geometry_3, Motion=kit.unit_vector_2)  # -> Geometry, Transform
right_window_triangle_2 = Move(Geometry=boundary_surfaces_16, Motion=unit_x_4)  # -> Geometry, Transform
left_window_triangle_2 = Move(Geometry=boundary_surfaces_15, Motion=unit_x_5)  # -> Geometry, Transform
map_to_surface = MapToSurface(Curve=left_window_triangle.Geometry, Source=left_window_triangle_2.Geometry, Target=boundary_surfaces_15)
map_to_surface_2 = MapToSurface(Curve=right_window_triangle.Geometry, Source=right_window_triangle_2.Geometry, Target=boundary_surfaces_14)
map_to_surface_3 = MapToSurface(Curve=right_window_triangle.Geometry, Source=right_window_triangle_2.Geometry, Target=boundary_surfaces_16)
map_to_surface_4 = MapToSurface(Curve=left_window_triangle.Geometry, Source=left_window_triangle_2.Geometry, Target=boundary_surfaces_13)
curve = ClusterOutput(map_to_surface)
curve_2 = ClusterOutput(map_to_surface_2)
curve_3 = ClusterOutput(map_to_surface_3)
curve_4 = ClusterOutput(map_to_surface_4)

# ==== cluster Kit
xz_plane = XZPlane(Origin=Point(0, 0, 0))
xz_plane_2 = XZPlane(Origin=Point(0, 0, 0))
xz_plane_3 = XZPlane(Origin=Point(0, 0, 0))
rectangle = Rectangle(Plane=xz_plane, XSize="1.5", YSize="1.5", Radius=0)  # -> Rectangle, Length
unit_x = UnitX(Factor="33")
rectangle_2 = Rectangle(Plane=xz_plane_2, XSize="2.725", YSize="6.13", Radius=0)  # -> Rectangle, Length
unit_x_2 = UnitX(Factor="15.25")
rectangle_3 = Rectangle(Plane=xz_plane_3, XSize="1.5", YSize="1.5", Radius=0)  # -> Rectangle, Length
unit_x_3 = UnitX(Factor="28.5")
move = Move(Geometry=rectangle.Rectangle, Motion=unit_x)  # -> Geometry, Transform
move_2 = Move(Geometry=rectangle_2.Rectangle, Motion=unit_x_2)  # -> Geometry, Transform
unit_z = UnitZ(Factor="6.3")
move_3 = Move(Geometry=rectangle_3.Rectangle, Motion=unit_x_3)  # -> Geometry, Transform
geometry = ClusterOutput(move.Geometry)
unit_z_2 = UnitZ(Factor="6.3")
geometry_2 = ClusterOutput(move_2.Geometry)
unit_vector = ClusterOutput(unit_z)
geometry_3 = ClusterOutput(move_3.Geometry)
unit_vector_2 = ClusterOutput(unit_z_2)

# ==== cluster Build
# BUILD WINDOWS
# BUILD HOUSE
construct_point = ConstructPoint(XCoordinate=0, YCoordinate=0, ZCoordinate=0)
construct_point_2 = ConstructPoint(XCoordinate=0, YCoordinate=0, ZCoordinate=0)
height_2_3 = Slider(6.13, range=0..20)
width = Slider(10.9, range=0..20)
length = Slider(18.6, range=0..20)
width_2 = Slider(10.9, range=0..20)
length_2 = Slider(18.6, range=0..20)
point = Point(construct_point)
point_2 = Point(construct_point_2)
yz_plane = YZPlane(Origin=point)
rectangle = Rectangle(Plane=point, XSize=width, YSize=length, Radius=0)  # -> Rectangle, Length
rectangle_2 = Rectangle(Plane=point_2, XSize=width_2, YSize=length_2, Radius=0)  # -> Rectangle, Length
unit_z = UnitZ(Factor=height_2_3)
move = Move(Geometry=rectangle_2.Rectangle, Motion=unit_z)  # -> Geometry, Transform
nn = Surface(rectangle.Rectangle)
splitatcorners = SplitAtCorners(Poly=rectangle.Rectangle, Angle=1)  # -> Corners, Parts
splitatcorners_2 = SplitAtCorners(Poly=move.Geometry, Angle=1)  # -> Corners, Parts
curve = Curve(splitatcorners.Parts)
point_3 = Point(splitatcorners.Corners)
list_item = ListItem(List=point_3, Index=0, Wrap=True)
yz_plane_2 = YZPlane(Origin=list_item)
point_4 = ClusterOutput(point_3)
curve_2 = Curve(splitatcorners_2.Parts)
point_5 = Point(splitatcorners_2.Corners)
line = Line(StartPoint=point_3, EndPoint=point_5)
xz_plane = XZPlane(Origin=point)
curve_middle = CurveMiddle(Curve=curve_2)
list_item_2 = ListItem(List=point_3, Index=Slider(2, range=0..4), Wrap=True)
new_windows = NewWindows(origin_2=list_item, origin=list_item_2)  # -> geometry, geometry_2
list_item_3 = ListItem(List=point_5, Index=[Slider(3, range=0..3), Slider(0, range=0..3)], Wrap=True)
list_item_4 = ListItem(List=point_5, Index=[Slider(2, range=0..3), Slider(1, range=0..3)], Wrap=True)
list_item_5 = ListItem(List=curve_middle, Index=[Slider(1, range=0..3), Slider(3, range=0..4)], Wrap=True)
unit_z_2 = UnitZ(Factor=Slider(3.07, range=0..20))
xz_plane_2 = XZPlane(Origin=list_item_2)
i = ClusterOutput(list_item_5)
move_2 = Move(Geometry=list_item_5, Motion=unit_z_2)  # -> Geometry, Transform
list_item_6 = ListItem(List=move_2.Geometry, Index=Slider(1, range=0..1), Wrap=True)
list_item_7 = ListItem(List=move_2.Geometry, Index=Slider(0, range=0..1), Wrap=True)
i_2 = ClusterOutput(list_item_6)
list_item_8 = ListItem(List=point_5, Index=Slider(1, range=0..3), Wrap=True)
i_3 = ClusterOutput(list_item_7)
list_item_9 = ListItem(List=point_5, Index=Slider(2, range=0..3), Wrap=True)
list_item_10 = ListItem(List=point_5, Index=Slider(0, range=0..3), Wrap=True)
list_item_11 = ListItem(List=point_5, Index=Slider(3, range=0..3), Wrap=True)
line_2 = Line(StartPoint=list_item_6, EndPoint=list_item_7)
line_3 = Line(StartPoint=list_item_3, EndPoint=list_item_6)
line_4 = Line(StartPoint=list_item_4, EndPoint=list_item_7)
all_curves = Merge(Data1=line, Data2=line_3, Data3=line_4, Data4=line_2, Data5=curve, Data6=curve_2)
all_points = Merge(Data1=point_3, Data2=point_5, Data3=move_2.Geometry)
result = ClusterOutput(all_curves)
result_2 = ClusterOutput(all_points)
list_item_12 = ListItem(
    List=all_points,
    Index=[Slider(3, range=0..10), Slider(2, range=0..10), Slider(6, range=0..10), Slider(7, range=0..10)],
    Wrap=True)
t2 = _4PointSurface(CornerA=list_item_8, CornerB=list_item_9, CornerC=list_item_7)
t1 = _4PointSurface(CornerA=list_item_10, CornerB=list_item_11, CornerC=list_item_6)
r2 = _4PointSurface(CornerA=list_item_8, CornerB=list_item_10, CornerC=list_item_6, CornerD=list_item_7)
r1 = _4PointSurface(CornerA=list_item_9, CornerB=list_item_11, CornerC=list_item_6, CornerD=list_item_7)
l1 = PlaneSurface(Plane=yz_plane_2, XSize=length, YSize=height_2_3)
w1 = PlaneSurface(Plane=xz_plane, XSize=width_2, YSize=height_2_3)
w2 = PlaneSurface(Plane=xz_plane_2, XSize=width_2, YSize=height_2_3)
l2 = PlaneSurface(Plane=yz_plane, XSize=length, YSize=height_2_3)
# DATA VISUALIZATION
old_windows = OldWindows(surface=l2, surface_2=l2, origin=list_item, surface_3=t1, surface_4=t1, origin_2=list_item_7)  # -> geometry, geometry_3, geometry_2, geometry_4
orientation_windows = Merge(Data1=old_windows.geometry, Data2=old_windows.geometry_3)
plane = ClusterOutput(l1)
plane_2 = ClusterOutput(w1)
plane_3 = ClusterOutput(w2)
plane_4 = ClusterOutput(l2)
surface = ClusterOutput(t2)
surface_2 = ClusterOutput(t1)
surface_3 = ClusterOutput(r2)
surface_4 = ClusterOutput(r1)
all_surfaces = Merge(Data1=t2, Data2=t1, Data3=r2, Data4=r1, Data5=l2, Data6=l1, Data7=w2, Data8=w1, Data9=nn)
y_surfaces = Merge(Data1=t2, Data2=t1, Data3=w1, Data4=w2)
result_3 = ClusterOutput(all_surfaces)
s1_s2 = Merge(Data1=t2, Data2=t1, Data3=l1, Data4=l2)
z_surfaces = Merge(Data1=r2, Data2=r1, Data3=nn)
x_surfaces = Merge(Data1=l1, Data2=l2)
unit_y = UnitY(Factor=Slider(0.1, range=0..0.3))
unit_z_3 = UnitZ(Factor=Slider(0.1, range=0..0.3))
all_windows = Merge(Data1=old_windows.geometry, Data2=old_windows.geometry_3)
unit_x = UnitX(Factor=Slider(0.1, range=0..0.3))
extrude = Extrude(Base=y_surfaces, Direction=unit_y)
extrude_2 = Extrude(Base=z_surfaces, Direction=unit_z_3)
windows = Merge(Data1=new_windows.geometry, Data2=new_windows.geometry_2)
extrude_3 = Extrude(Base=x_surfaces, Direction=unit_x)
window_extrusions_for_structural_analysi = WindowExtrusionsForStructuralAnalysis(
    d1=old_windows.geometry,
    d2=old_windows.geometry_3,
    breps_a_2=extrude_3,
    d1_2=old_windows.geometry_2,
    d2_2=old_windows.geometry_4,
    breps_a=extrude)  # -> surface_4, surface_3; "Window extrusions for structural analysis"
surface_5 = ClusterOutput(window_extrusions_for_structural_analysi.surface_4)
surface_6 = ClusterOutput(window_extrusions_for_structural_analysi.surface_3)
windows_2 = Surface(windows)
data_visualizatio = DataVisualizatio()

# ==== cluster DataVisualizatio
# LOADING DATA
panel = Panel("\data.csv")
# LOGGING DATA
number_slider = Slider(10, range=0..10)
# Example Assumes:
# 
# 2 Variables: x,y
# 1 Objective: z
panel_2 = Panel("-2 to 2")
read_file = ReadFile(File=panel, PerLineParse=True)
range = Range(Domain=panel_2, Steps=number_slider)
data = Data(read_file)
cross_reference = CrossReference(ListListA=range, ListListB=range, CrossMode=1)  # -> ListListA, ListListB
expression = Expression(x=cross_reference.ListListA, y=cross_reference.ListListB, Expression="x² + y²")
data_2 = Data(["in:X component,in:Y component,out:Z component,img", "-1.6,-2,6.56,Xcomponent-1.6_Ycomponent-2.png", "-0.8,-2,4.64,Xcomponent-0.8_Ycomponent-2.png", "-0.4,-2,4.16,Xcomponent-0.4_Ycomponent-2.png", "0,-2,4,Xcomponent0_Ycomponent-2.png", "0.4,-2,4.16,Xcomponent0.4_Ycomponent-2.png"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])
construct_point = ConstructPoint(XCoordinate=cross_reference.ListListA, YCoordinate=cross_reference.ListListB, ZCoordinate=expression)
panel_3 = Panel(data_2)
read_csv = ReadCSV(CSVString=data_2, Delimiter=",")  # -> Headers, Values
# Using Animate to Iterate through Variables to Test...
# Using Colibri to Log Data...
# RightClick > Animate
# --Set View
# --Set Interval (0 to N-1)
# --Set Frame Count (N+1)
# --Set File Storage Location
# N: how many data points you have...
number_slider_2 = Slider(120, range=0..120)
panel_4 = Panel(read_csv.Headers)
# You will have your own way of generating the data... this is just to demonstrate.
point = Point(construct_point)
data_3 = Data(read_csv.Values)
panel_5 = Panel(point)
# List of Data Points
data_4 = Data(point)
flip_matrix = FlipMatrix(Data=data_3)
list_item = ListItem(List=data_4, Index=number_slider_2, Wrap=True)
list_item_2 = ListItem(List=flip_matrix, Index="0", Wrap=True)
list_item_3 = ListItem(List=flip_matrix, Index="1", Wrap=True)
list_item_4 = ListItem(List=flip_matrix, Index="2", Wrap=True)
number = Number(list_item_3)
number_2 = Number(list_item_4)
number_3 = Number(list_item_2)
# Communicate data to Colibri using Output Data
deconstruct = Deconstruct(Point=list_item)  # -> XComponent, YComponent, ZComponent
construct_point_2 = ConstructPoint(XCoordinate=number_3, YCoordinate=number, ZCoordinate=number_2)
# Toggle to 'True' and start animating...
boolean_toggle = BooleanToggle(True)
point_2 = Point(flatten(construct_point_2))
colibri_out = ColibriOutputs(Z_component=flatten(deconstruct.ZComponent))
data_5 = Data(boolean_toggle)
colibri_out_2 = ColibriOutputs(X_component=flatten(deconstruct.XComponent), Y_component=flatten(deconstruct.YComponent))
remove_duplicate_points_karamba3d = RemoveDuplicatePointsKaramba3D(Point=point_2, LimitDistance=0.005)  # -> OutPoint, Info, Indexes
# QUICK DIRTY VISUALISATION
point_3 = Point(flatten(remove_duplicate_points_karamba3d.OutPoint))
deconstruct_2 = Deconstruct(Point=point_3)  # -> XComponent, YComponent, ZComponent
number_4 = Number(flatten(deconstruct_2.ZComponent))
ca = ColibriAggregator(Folder="C:\ColibriRandom", Inputs=colibri_out_2, Outputs=colibri_out, Write=data_5, recordingMode=0)
bounds = Bounds(Numbers=number_4)
delaunay_mesh = DelaunayMesh(Points=point_3, Plane=PlaneXY(0, 0, 0))
deconstruct_domain = DeconstructDomain(Domain=bounds)  # -> Start, End
min = Panel(deconstruct_domain.Start)
max = Panel(deconstruct_domain.End)
deconstruct_mesh = DeconstructMesh(Mesh=delaunay_mesh)  # -> Vertices, Faces, Colours, Normals
gradient = Gradient(
    LowerLimit=min,
    UpperLimit=max,
    Parameter=deconstruct_2.ZComponent,
    stops=[0: RGB(234, 38, 0), 0.25: RGB(234, 126, 0), 0.5: RGB(254, 244, 84), 0.75: RGB(173, 203, 249), 1: RGB(75, 107, 169)])
construct_mesh = ConstructMesh(Vertices=deconstruct_mesh.Vertices, Faces=deconstruct_mesh.Faces, Colours=gradient)

# ==== cluster OldWindows
panel = Panel("3")
division = Division(A="2", B="12")
division_2 = Division(A=Slider(3, range=2..3), B="12")
division_3 = Division(A="4", B="5")
division_4 = Division(A=Slider(1, range=1..3), B="5")
division_5 = Division(A="1", B="5")
division_6 = Division(A="6", B="12")
division_7 = Division(A=Slider(3, range=2..4), B="5")
division_8 = Division(A=Slider(2, range=2..3), B="12")
construct_point = ConstructPoint(XCoordinate=division, YCoordinate=division_4, ZCoordinate=0)
construct_point_2 = ConstructPoint(XCoordinate=division_2, YCoordinate=division_3, ZCoordinate=0)
construct_point_3 = ConstructPoint(XCoordinate=division_8, YCoordinate=division_7, ZCoordinate=0)
construct_point_4 = ConstructPoint(XCoordinate=division_6, YCoordinate=division_5, ZCoordinate=0)
surface = ClusterInput()
surface_2 = ClusterInput()
surface_3 = ClusterInput()
surface_4 = ClusterInput()
evaluate_surface = EvaluateSurface(Surface=reparameterize(surface), Point=construct_point)  # -> Point, Normal, UDirection, VDirection, Frame
evaluate_surface_2 = EvaluateSurface(Surface=reparameterize(surface_2), Point=construct_point_2)  # -> Point, Normal, UDirection, VDirection, Frame
evaluate_surface_3 = EvaluateSurface(Surface=reparameterize(surface_3), Point=construct_point_4)  # -> Point, Normal, UDirection, VDirection, Frame
evaluate_surface_4 = EvaluateSurface(Surface=reparameterize(surface_4), Point=construct_point_3)  # -> Point, Normal, UDirection, VDirection, Frame
xz_plane = XZPlane(Origin=Point(0, 0, 0))
yz_plane = YZPlane(Origin=evaluate_surface.Point)
rectangle_2pt = Rectangle2Pt(Plane=xz_plane, PointA=evaluate_surface_3.Point, PointB=evaluate_surface_4.Point, Radius=0)  # -> Rectangle, Length
rectangle_2pt_2 = Rectangle2Pt(Plane=yz_plane, PointA=evaluate_surface.Point, PointB=evaluate_surface_2.Point, Radius=0)  # -> Rectangle, Length
origin = ClusterInput()
number_slider = Slider(2, range=1..2)
yz_plane_2 = YZPlane(Origin=origin)
s2_window = Surface(rectangle_2pt.Rectangle)
s1_window = Surface(rectangle_2pt_2.Rectangle)
unit_x = UnitX(Factor="1.8")
origin_2 = ClusterInput()
unit_y = UnitY(Factor=Slider(10, range=2..13))
xz_plane_2 = XZPlane(Origin=origin_2)
s1_windows = LinearArray(Geometry=s1_window, Direction=unit_y, Count=Slider(2, range=1..4))  # -> Geometry, Transform
s2_windows = LinearArray(Geometry=s2_window, Direction=unit_x, Count=Slider(2, range=0..2))  # -> Geometry, Transform
s1_windows_p = Project(Geometry=s1_windows.Geometry, Plane=yz_plane_2)  # -> Geometry, Transform
s2_windows_p = Project(Geometry=s2_windows.Geometry, Plane=xz_plane_2)  # -> Geometry, Transform
geometry = ClusterOutput(s1_windows.Geometry)
geometry_2 = ClusterOutput(s2_windows.Geometry)
geometry_3 = ClusterOutput(s1_windows_p.Geometry)
geometry_4 = ClusterOutput(s2_windows_p.Geometry)

# ==== cluster WindowExtrusionsForStructuralAnalysis
d1 = ClusterInput()
d2 = ClusterInput()
d1_2 = ClusterInput()
d2_2 = ClusterInput()
y_windows = Merge(Data1=d1, Data2=d2)
x_windows = Merge(Data1=d1_2, Data2=d2_2)
unit_y = UnitY(Factor="1")
unit_x = UnitX(Factor="1")
extrude = Extrude(Base=y_windows, Direction=unit_x)
extrude_2 = Extrude(Base=x_windows, Direction=unit_y)
unit_x_2 = UnitX(Factor="-0.5")
unit_y_2 = UnitY(Factor="-0.5")
move = Move(Geometry=extrude_2, Motion=unit_y_2)  # -> Geometry, Transform
move_2 = Move(Geometry=extrude, Motion=unit_x_2)  # -> Geometry, Transform
breps_a = ClusterInput()
breps_a_2 = ClusterInput()
solid_difference = SolidDifference(BrepsA=breps_a, BrepsB=move.Geometry)  # -> flatten(Result)
solid_difference_2 = SolidDifference(BrepsA=breps_a_2, BrepsB=move_2.Geometry)
deconstruct_brep = DeconstructBrep(Brep=solid_difference)  # -> Faces, Edges, Vertices
deconstruct_brep_2 = DeconstructBrep(Brep=solid_difference_2)  # -> flatten(Faces), Edges, Vertices
list_item = ListItem(List=deconstruct_brep.Faces, Index=Slider(16, range=0..37), Wrap=True)  # -> flatten(Item)
list_item_2 = ListItem(List=flatten(deconstruct_brep_2.Faces), Index=flatten([Slider(5, range=0..27), Slider(18, range=0..27)]), Wrap=True)  # -> flatten(Item)
surface = Surface(list_item)
surface_2 = Surface(flatten(list_item_2))
surface_3 = ClusterOutput(surface)
surface_4 = ClusterOutput(surface_2)

# ==== cluster NewWindows
number_slider = Slider(3, range=1..3)
number_slider_2 = Slider(3, range=1..3)
yz_plane = YZPlane(Origin=Point(0, 0, 0))
number_slider_3 = Slider(3, range=1..3)
rectangle = Rectangle(Plane=yz_plane, XSize=Domain(-1, 1), YSize=Domain(-2, 2), Radius=0)  # -> Rectangle, Length
unit_y = UnitY(Factor="3")
number_slider_4 = Slider(9, range=3..9)
origin = ClusterInput()
unit_z = UnitZ(Factor=1)
area = Area(Geometry=rectangle.Rectangle)  # -> Area, Centroid
upper_windows = UpperWindows(origin=origin)
move = Move(Geometry=rectangle.Rectangle, Motion=unit_z)  # -> Geometry, Transform
number_slider_5 = Slider(2, range=1..2)
unit_y_2 = UnitY(Factor=1)
move_2 = Move(Geometry=move.Geometry, Motion=unit_y)  # -> Geometry, Transform
origin_2 = ClusterInput()
linear_array = LinearArray(Geometry=move_2.Geometry, Direction=unit_y_2, Count=10)  # -> Geometry, Transform
yz_plane_2 = YZPlane(Origin=origin_2)
geometry = ClusterOutput(linear_array.Geometry)
project = Project(Geometry=linear_array.Geometry, Plane=yz_plane_2)  # -> Geometry, Transform
geometry_2 = ClusterOutput(project.Geometry)

# ==== cluster UpperWindows
xz_plane = XZPlane(Origin=Point(0, 0, 0))
rectangle = Rectangle(Plane=xz_plane, XSize=Slider(2, range=1..3), YSize=Slider(2, range=1..3), Radius=0)  # -> Rectangle, Length
unit_x = UnitX(Factor="4")
unit_z = UnitZ(Factor="7")
move = Move(Geometry=rectangle.Rectangle, Motion=unit_z)  # -> Geometry, Transform
unit_x_2 = UnitX(Factor="2")
move_2 = Move(Geometry=move.Geometry, Motion=unit_x)  # -> Geometry, Transform
origin = ClusterInput()
linear_array = LinearArray(Geometry=move_2.Geometry, Direction=unit_x_2, Count=Slider(2, range=1..2))  # -> Geometry, Transform
xz_plane_2 = XZPlane(Origin=origin)
project = Project(Geometry=linear_array.Geometry, Plane=xz_plane_2)  # -> Geometry, Transform
