# Grasshopper definition berni_iterator.gh (Grasshopper 1.0.7)

python = GhPythonScript()  # -> out, options
# ---------- python: Python ----------
__author__ = "tamk"
__version__ = "2024.03.25"

from random import randint
import rhinoscriptsyntax as rs

n_panels = 20
n_windows = 4
n_options = 100

options = set()

while(True):
    _option = set()
    
    while(True):
        _ind = randint(0, n_panels)
        if _ind not in _option:
            _option.add(_ind)
        if len(_option) == n_windows:
            break
            
    _option = tuple(_option)
    
    if _option not in options:
        options.add(_option)
        
    if len(options) == n_options:
        break

print(options)
# ---------- end python ----------
item = ListItem(List=python.options, Index=Slider(0, range=0..100), Wrap=True)
python_2 = GhPythonScript(x=item)  # -> out, a
# ---------- python_2: Python ----------
__author__ = "tamk"
__version__ = "2024.03.25"

import rhinoscriptsyntax as rs

a=x
# ---------- end python_2 ----------
panel = Panel(python_2.a)
