# Grasshopper definition load_model_on_gh.gh (Grasshopper 1.0.7)

panel = Panel("Y:/Documents/GitHub/HKU/HKU_202324S2_DESN3002_ARCH7378/ScriptsForIndividual/Bernadette/model_mape_norm")
python = GhPythonScript(port="9009")  # -> out, proxy; inputs port: Int32
# ---------- python: Python ----------
__author__ = "user"
__version__ = "2024.01.11"

import rhinoscriptsyntax as rs

from compas_cloud import Proxy

if port:
    proxy = Proxy(port=port)
# ---------- end python ----------
genes = GenePool(Decimals=0, Maximum=1, Minimum=0, Value=[0.5, 0.5, 0, 1, 0, 0, 0, 0, 1, 1, 0.5, 0, 0.5, 0, 1, 0.5, 0, 0.5, 0.5, 0.5])
data = Data(python.proxy)
data_2 = Data(data)
python_2 = GhPythonScript(proxy=data_2, file_path=panel)  # -> proxy, out
# ---------- python_2: Python ----------
__author__ = "user"
__version__ = "2024.01.11"

import rhinoscriptsyntax as rs

if file_path:
    load_surrogate_model = proxy.function('hkua_dex_projects.berni.load_surrogate_model')
    load_surrogate_model(file_path)
# ---------- end python_2 ----------
panel_2 = Panel("""3
8
9
14""")
int = Integer(Slider(18, range=0..100))
int_2 = Integer(Slider(10, range=0..10))
python_3 = GhPythonScript(indices=panel_2, n="20")  # -> out, binary; inputs indices: list of Int32, n: Int32
# ---------- python_3: Python ----------
__author__ = "tamk"
__version__ = "2024.05.11"

import rhinoscriptsyntax as rs

binary = [1. if _i in indices else 0. for _i in range(n)]
# ---------- end python_3 ----------
dom = ConstructDomain(DomainStart=0, DomainEnd=int)
dom_2 = ConstructDomain(DomainStart=0, DomainEnd=int_2)
rectangle = Rectangle(Plane=PlaneXY(0, 0, 0), XSize=dom_2, YSize=dom, Radius=0)  # -> Rectangle, Length
data_3 = Data(python_2.proxy)
srf = Surface(rectangle.Rectangle)
python_4 = GhPythonScript(proxy=data_3, config=genes)  # -> out, proxy, sensors; inputs config: list
# ---------- python_4: Python ----------
__author__ = "user"
__version__ = "2024.01.11"

import rhinoscriptsyntax as rs
import Grasshopper as gh
def listToTree(nestedList):
    
    """ Convert a nested python iterable to a datatree """
    
    dt = gh.DataTree[object]()
    for i,l in enumerate(nestedList):
        dt.AddRange(l,gh.Kernel.Data.GH_Path(i))
        
    return dt

if config:
    surrogate_model_predict = proxy.function('hkua_dex_projects.berni.surrogate_model_predict')
    sensors = surrogate_model_predict(config)
    
    #sensors = listToTree(sensors)
# ---------- end python_4 ----------
mesh_uv = MeshSurface(Surface=srf, UCount=int_2, VCount=int, Overhang=True, Equalize=False)
num = Number(python_4.sensors)
avr = Average(Input=num)
average_da = Panel(avr)
mesh = Mesh(mesh_uv)
panel_3 = Panel(num)
faceb = FaceBoundaries(Mesh=mesh)
lng = ListLength(List=num)  # -> flatten(Length)
crv = Curve(faceb)
item = ListItem(List=lng, Index=0, Wrap=True)
area = Area(Geometry=crv)  # -> Area, Centroid
gradient = Gradient(
    LowerLimit=Slider(0.5, range=0..1),
    UpperLimit=Slider(0, range=0..1),
    Parameter=num,
    stops=[0: RGB(234, 38, 0), 0.25: RGB(234, 126, 0), 0.5: RGB(254, 244, 84), 0.75: RGB(173, 203, 249), 1: RGB(75, 107, 169)])
partition = PartitionList(List=crv, Size=item)  # -> simplify(Chunks)
pt = Point(area.Centroid)
mesh_2 = Mesh(partition)
preview = CustomPreview(Geometry=mesh_2, Material=gradient)
points = PointList(Points=pt)
